# Grasshopper definition Building Height Attractor.gh (Grasshopper 1.0.7)
# plug-ins: Pufferfish

# ----
# Building Height Attractor
# Requires Layer called 'KeyPoints' where you place the attractor points.
# Uncertain if it works with more than 2 points for now.
pipeline = GeometryPipeline(
    GroupByLayer=False,
    GroupByType=False,
    IncludeHidden=True,
    IncludeLocked=True,
    LayerFilter="*KeyPoints",
    NameFilter="*",
    SublayerFiltering=True,
    TypeFilter=1)
# Connects to Boundary Surfaces in 'Buildings'
relay = Relay()
# Connects to ftpt (Building Footprints) from Buildings Component in 'Buildings'
relay_2 = Relay()
pcen = PolygonCenter(Polyline=relay_2)  # -> CenterV, CenterE, CenterA
pt = Point(pcen.CenterA)
dist = Distance(PointA=pt, PointB=pipeline)
avr = Average(Input=dist)
larger = LargerThan(FirstNumber=dist, SecondNumber=avr)  # -> LargerThan, OrEqualTo
dispatch = Dispatch(List=dist, DispatchPattern=larger.LargerThan)  # -> ListA, ListB
flatten = FlattenTree(Tree=dispatch.ListA, Path="{0}")
bnd = Bounds(Numbers=flatten)
dom = ConstructDomain(DomainStart=Slider(1, range=0..1), DomainEnd=Slider(0, range=0..100))
remap = RemapNumbers(Value=flatten, Source=bnd, Target=dom)  # -> Mapped, Clipped
eº = PowerOfE(Value=remap.Mapped)
bnd_2 = Bounds(Numbers=eº)
dom_2 = ConstructDomain(DomainStart=Slider(8, range=0..10), DomainEnd=Slider(27, range=0..100))
remap_2 = RemapNumbers(Value=eº, Source=bnd_2, Target=dom_2)  # -> Mapped, Clipped
# Filters out weird duplicate surfaces
culln = CullNth(List=relay, CullFrequency=2)
roundn = RoundToNearest(
    NumbersX=remap_2.Mapped,
    NumbersY=[3, 6, 9, 12, 15, 18, 21, 24, 27, 30, 33, 36, 69, 42, 45, 48, 51, 54, 57, 60, 63, 66, 69, 72],
    RemapX=False)  # -> flatten(Nearest), Index, Difference, RemappedX
flatten_2 = FlattenTree(Tree=culln, Path="{0}")
graft = GraftTree(Tree=flatten_2, IncludeEmptyLists=True, IncludeNullItems=True)
graft_2 = GraftTree(Tree=roundn.Nearest, IncludeEmptyLists=True, IncludeNullItems=True)
Z = UnitZ(Factor=graft_2)
extr = Extrude(Base=graft, Direction=Z)
cap = CapHoles(Brep=extr)
preview_3d_buildings = CustomPreview(Geometry=cap, Shader=ColourSwatch(SwatchColor=RGB(225, 225, 227)))
