# Grasshopper definition CityScan v1.4.7.gh (Grasshopper 1.0.7)
# plug-ins: DeCodingSpaces, Kangaroo2 Components, Pufferfish, Python, GhPython Script, Human, LunchBox, Offset new, ClipperComponents

crv = Curve([<curve referenced from the Rhino model> x2])
length_threshold = Slider(0.894, range=0..1)
explode = Explode(Curve=crv, Recursive=True)  # -> Segments, Vertices
len = Length(Curve=explode.Segments)

# ----
# Input Geometry
pipeline = GeometryPipeline(
    GroupByLayer=False,
    GroupByType=False,
    IncludeHidden=True,
    IncludeLocked=True,
    LayerFilter="*ScenarioMax::Main Streets",
    NameFilter="*",
    SublayerFiltering=True,
    TypeFilter=4)
pipeline_2 = GeometryPipeline(
    GroupByLayer=False,
    GroupByType=False,
    IncludeHidden=True,
    IncludeLocked=True,
    LayerFilter="*ScenarioMax::Connections",
    NameFilter="*",
    SublayerFiltering=True,
    TypeFilter=4)
pipeline_3 = GeometryPipeline(
    GroupByLayer=False,
    GroupByType=False,
    IncludeHidden=True,
    IncludeLocked=True,
    LayerFilter="*ScenarioMax::Boundary",
    NameFilter="*",
    SublayerFiltering=True,
    TypeFilter=4)

smaller = SmallerThan(FirstNumber=len, SecondNumber=length_threshold)  # -> SmallerThan, OrEqualTo
dispatch = Dispatch(List=explode.Segments, DispatchPattern=smaller.SmallerThan)  # -> ListA, ListB
crv_2 = Curve(dispatch.ListB)
shift = ShiftList(List=crv_2, Shift="1", Wrap=True)
division = Division()
shift_2 = ShiftList(List=crv_2, Shift="-1", Wrap=True)
pshift = ShiftPaths(Data=shift, Offset=-1)
pshift_2 = ShiftPaths(Data=shift_2, Offset=-1)

# ----
# Raw Street Network
number_slider = Slider(0, range=0..10)
buildable_boundary = Curve(reparameterize(pipeline_3))
explode_2 = Explode(Curve=pipeline, Recursive=True)  # -> Segments, Vertices
topoly = CurveToPolyline(Curve=buildable_boundary, ToleranceDistance=0, ToleranceAngle=0)  # -> Polyline, Segments
geo = Geometry([explode_2.Segments, pipeline_2])
redpline = Reduce(Polyline=topoly.Polyline, Tolerance=Slider(10, range=0..10))  # -> Polyline, Reduction
flatten = FlattenTree(Tree=geo, Path="{0}")
street_network_generator = StreetNetworkGenerator(
    Boundary=redpline.Polyline,
    IniStreets=flatten,
    MinLength=Slider(70, range=0..100),
    MaxLength=Slider(500, range=0..700),
    MinDist=Slider(55, range=0..100),
    RandomAngle=number_slider,
    MaxArms=Slider(1, range=0..10),
    TreeDepth=Slider(6, range=0..10),
    ProbabilityToAddArms=1,
    SeedForRandom=Slider(13, range=0..50))
extract_polygons = PolygonsFromLines(Lines=street_network_generator, MinBlockSize=Slider(20, range=0..100))  # -> Polygons, SynchronizedValues
parcels = Parcels(
    Polygons=extract_polygons.Polygons,
    ConnectionDistance=20,
    StreetOffset=Slider(0, range=0..100),
    PlotWidthThreshold=Slider(63, range=0..300),
    Precision=100)

llx = LineLine(Line1=graft(crv_2), Line2=graft(pshift_2))  # -> ParamA, ParamB, PointA, PointB
llx_2 = LineLine(Line1=graft(pshift), Line2=graft(crv_2))  # -> ParamA, ParamB, PointA, PointB
eval = EvaluateCurve(Curve=graft(crv_2), Parameter=0.5)  # -> Point, Tangent, Angle
eval_2 = EvaluateCurve(Curve=graft(pshift_2), Parameter=0.5)  # -> Point, Tangent, Angle
eval_3 = EvaluateCurve(Curve=graft(crv_2), Parameter=0.5)  # -> Point, Tangent, Angle
eval_4 = EvaluateCurve(Curve=graft(pshift), Parameter=0.5)  # -> Point, Tangent, Angle
avr = Average(Input=[eval.Point, eval_2.Point])
avr_2 = Average(Input=[eval_3.Point, eval_4.Point])
nullrep = ReplaceNulls(Items=llx.PointA, Replacements=avr)  # -> Items, Count
nullrep_2 = ReplaceNulls(Items=llx_2.PointA, Replacements=avr_2)  # -> Items, Count
ln = Line(StartPoint=nullrep.Items, EndPoint=nullrep_2.Items)

geo_2 = Geometry(parcels)
# Network Smoothing
# Version 2.
explode_3 = Explode(Curve=geo_2, Recursive=True)  # -> Segments, Vertices
flatten_2 = FlattenTree(Tree=explode_3.Segments, Path="{0}")
dupln = RemoveDuplicateLines(Lines=flatten_2, Tolerance=0.01)
shatter = MultiplesCurvesShatter(Curves=dupln)  # -> Points, Curves, Parame
crv_3 = Curve(shatter.Curves)
end = EndPoints(Curve=crv_3)  # -> Start, End
flatten_3 = FlattenTree(Tree=end.Start, Path="{0}")  # -> graft(Tree)
cps = ClosestPoints(Point=flatten(end.Start), Cloud=flatten(end.Start), Count=6)  # -> ClosestPoint, CPIndex, Distance
graft = GraftTree(Tree=end.Start, IncludeEmptyLists=True, IncludeNullItems=True)  # -> simplify(Tree)
graft_2 = GraftTree(Tree=end.Start, IncludeEmptyLists=True, IncludeNullItems=True)
graft_3 = GraftTree(Tree=end.End, IncludeEmptyLists=True, IncludeNullItems=True)
dist = Distance(PointA=flatten_3, PointB=cps.ClosestPoint)
radius_for_intersection_smoothing = Slider(25, range=0..100)
equalst = EqualityWithinTolerance(FirstNumber=dist, SecondNumber=0, Tolerance=Slider(0.01, range=0..0.01))  # -> Equality, Inequality
index = ItemIndex(List=equalst.Equality, Item=equalst.Equality)
cull = CullPattern(List=index, CullPattern=equalst.Equality)
replace = ReplaceItems(List=dist, Indices=cull, Wrap=True)
smaller_2 = SmallerThan(FirstNumber=replace, SecondNumber=radius_for_intersection_smoothing)  # -> SmallerThan, OrEqualTo
nullrep_3 = ReplaceNulls(Items=smaller_2.OrEqualTo, Replacements=Toggle(False))  # -> Items, Count
cull_2 = CullPattern(List=simplify(cps.ClosestPoint), CullPattern=simplify(nullrep_3.Items))
pdecon = Deconstruct(Point=graft)  # -> XComponent, YComponent, ZComponent
index_2 = ItemIndex(List=cull_2, Item=cull_2)
pdecon_2 = Deconstruct(Point=cull_2)  # -> XComponent, YComponent, ZComponent
merge = Merge(Data1=pdecon_2.YComponent, Data2=pdecon.YComponent)
merge_2 = Merge(Data1=pdecon_2.ZComponent, Data2=pdecon.ZComponent)
merge_3 = Merge(Data1=pdecon_2.XComponent, Data2=pdecon.XComponent)
dcon = DeleteConsecutive(Set=merge, Wrap=False)  # -> Set, Count
dcon_2 = DeleteConsecutive(Set=merge_2, Wrap=False)  # -> Set, Count
dcon_3 = DeleteConsecutive(Set=merge_3, Wrap=False)  # -> Set, Count
avr_3 = Average(Input=dcon.Set)
avr_4 = Average(Input=dcon_2.Set)
avr_5 = Average(Input=dcon_3.Set)
pt = ConstructPoint(XCoordinate=avr_5, YCoordinate=avr_3, ZCoordinate=avr_4)
item = ListItem(List=pt, Index=index_2, Wrap=True)
flatten_4 = FlattenTree(Tree=pt, Path="{0}")
xy = XYPlane(Origin=item)
cir = Circle(Plane=xy, Radius=radius_for_intersection_smoothing)
cp = ClosestPoint(Point=graft_3, Cloud=flatten_4)  # -> ClosestPoint, CPIndex, Distance
cp_2 = ClosestPoint(Point=graft_2, Cloud=flatten_4)  # -> ClosestPoint, CPIndex, Distance
ln_2 = Line(StartPoint=cp_2.ClosestPoint, EndPoint=cp.ClosestPoint)
dupln_2 = RemoveDuplicateLines(Lines=flatten(ln_2), Tolerance=Slider(1, range=0..10))
len_2 = Length(Curve=dupln_2)
equalst_2 = EqualityWithinTolerance(FirstNumber=len_2, SecondNumber=0, Tolerance=0.001)  # -> Equality, Inequality
cull_3 = CullPattern(List=dupln_2, CullPattern=equalst_2.Inequality)
street_network = Geometry(cull_3)

number_slider_2 = Slider(4, range=0..10)  # disabled
number_slider_3 = Slider(7.1, range=0..10)  # disabled

# ----
# Create (raw) Blocks & expanded boundary
number_slider_4 = Slider(9, range=0..100)
offset_int = OffsetIntersection(Curves=street_network, OutOffset=number_slider_4)  # -> Outer, Inner
expanded_boundary = Geometry(offset_int.Outer)
raw_blocks = Geometry(offset_int.Inner)

geo_3 = Geometry(street_network)  # disabled
_1_process_geometry = _1ProcessGeometry(Path=geo_3, SegmentLength=10000)  # -> Object, Segments, Vectors, Ids; disabled
_2_build_graph = _2BuildGraph(
    Object=_1_process_geometry.Object,
    LengthCoefficient=0,
    AngularCoefficient=1,
    AdditionalEdgeWeightCoefficient=0,
    CalculateDegree=False,
    CalculateInverseGraph=False,
    CopyObject=True)  # -> Object, InverseGraphEdges, Vertices, ReferencedEdges, DegreeCentrality; disabled
geo_4 = Geometry(_1_process_geometry.Segments)  # disabled
_3_shortest_path_floyd_warshal = _3ShortestFloydWarshal(Object=_2_build_graph.Object, CopyObject=True, IncludeMaA=False, UseGPU=False)  # disabled
_4_f_w_get_paths = _4FWGetPaths(
    Object=_3_shortest_path_floyd_warshal,
    PairwiseShortestPaths=False,
    Radius=0,
    CopyObject=True,
    MaskInputString="00000011",
    PathInfoForPoints=False,
    UseGPU=False)  # -> BetweennessCentrality, ClosenessCentrality, Gravity, BetweennessCentralityWeighted, ClosenessCentralityWeighted, SupplementaryGeometry, PathsInformation; disabled
dom = ConstructDomain(DomainStart=0, DomainEnd=1)  # disabled
recrvdom = RemapCurveDomain(Curve=_1_process_geometry.Segments, Domain=dom)  # -> Remapped, Original, New; disabled
ln_3 = NaturalLogarithm(Value=_4_f_w_get_paths.BetweennessCentrality)  # disabled
bnd = Bounds(Numbers=ln_3)  # disabled
eval_5 = EvaluateCurve(Curve=recrvdom.Remapped, Parameter=0.5)  # -> Point, Tangent, Angle; disabled
eval_6 = EvaluateCurve(Curve=recrvdom.Remapped, Parameter=0.5)  # -> Point, Tangent, Angle; disabled
remap = RemapNumbers(Value=ln_3, Source=bnd, Target=Domain(0, 1))  # -> Mapped, Clipped; disabled
number_slider_5 = Slider(32, range=0..100)  # disabled
number_slider_6 = Slider(32, range=0..100)  # disabled
boundary = Curve(pipeline_3)  # disabled
primary_streets = Curve(pipeline)  # disabled
gradient = Gradient(LowerLimit=0, UpperLimit=1, Parameter=remap.Mapped, stops=[0: RGB(0, 128, 0), 0.5: RGB(255, 255, 0), 1: RGB(255, 0, 0)])  # disabled
ribbon = Ribbon(Curves=boundary, Distance=number_slider_5, Union=False)  # disabled
ribbon_2 = Ribbon(Curves=primary_streets, Distance=number_slider_6, Union=False)  # disabled
incurves = PointInCurves(Point=eval_5.Point, Curves=ribbon)  # -> Relationship, Index, Point; disabled
incurves_2 = PointInCurves(Point=eval_6.Point, Curves=ribbon_2)  # -> Relationship, Index, Point; disabled
equals = Equality(FirstNumber=incurves.Relationship, SecondNumber=2)  # -> Equality, Inequality; disabled
number_slider_7 = Slider(5, range=0..10)  # disabled
equals_2 = Equality(FirstNumber=incurves_2.Relationship, SecondNumber=2)  # -> Equality, Inequality; disabled
dispatch_2 = Dispatch(List=graft(incurves.Relationship), DispatchPattern=graft(equals.Equality))  # -> ListA, ListB; disabled
dispatch_3 = Dispatch(List=graft(incurves_2.Relationship), DispatchPattern=graft(equals_2.Equality))  # -> ListA, ListB; disabled
previewlw = CustomPreviewLineweights(Geometry=geo_4, Shader=gradient, Thickness=number_slider_7, Absolute=False)  # disabled
pow = Power(A=dispatch_2.ListA, B=0)  # disabled
pow_2 = Power(A=dispatch_3.ListB, B=0)  # disabled
pow_3 = Power(A=dispatch_3.ListA, B=0)  # disabled
lng = ListLength(List=pow)  # disabled
lng_2 = ListLength(List=pow_3)  # disabled
lng_3 = ListLength(List=pow_2)  # disabled
dispatch_4 = Dispatch(List=0, DispatchPattern=lng)  # -> ListA, ListB; disabled
dispatch_5 = Dispatch(List=0, DispatchPattern=lng_2)  # -> ListA, ListB; disabled
dispatch_6 = Dispatch(List=0, DispatchPattern=lng_3)  # -> ListA, ListB; disabled
number_slider_8 = Slider(6, range=0..10)  # disabled
number_slider_9 = Slider(9.7, range=0..10)  # disabled
data = Data([dispatch_4.ListB, pow])  # disabled
data_2 = Data([dispatch_5.ListB, pow_3])  # disabled
data_3 = Data([dispatch_6.ListB, pow_2])  # disabled
equals_3 = Equality(FirstNumber=data, SecondNumber=0)  # -> Equality, Inequality; disabled
multiplication = Multiplication(A=data, B=number_slider_9)  # disabled
equals_4 = Equality(FirstNumber=data_2, SecondNumber=0)  # -> Equality, Inequality; disabled
multiplication_2 = Multiplication(A=data_2, B=number_slider_3)  # disabled
multiplication_3 = Multiplication(A=data_3, B=number_slider_2)  # disabled
equals_5 = Equality(FirstNumber=data_3, SecondNumber=0)  # -> Equality, Inequality; disabled
cull_4 = CullPattern(List=multiplication, CullPattern=equals_3.Inequality)  # disabled
cull_5 = CullPattern(List=multiplication_2, CullPattern=equals_4.Inequality)  # disabled
cull_6 = CullPattern(List=multiplication_3, CullPattern=equals_5.Inequality)  # disabled
merge_4 = Merge(Data1=cull_5, Data2=cull_6)  # -> flatten(Result); disabled
boundary_2 = BoundarySurfaces(Edges=raw_blocks)  # disabled
multiplication_4 = Multiplication(A=merge_4, B=2)  # disabled
join = BrepJoin(Breps=boundary_2)  # -> Breps, Closed; disabled
division_2 = Division(B=2)  # disabled
neg = Negative(Value=merge_4)  # disabled
edges = BrepEdges(Brep=join.Breps)  # -> Naked, Interior, NonManifold; disabled
ribbon_3 = Ribbon(Curves=graft(recrvdom.Remapped), Distance=graft(multiplication_4), Union=True)  # disabled
join_2 = JoinCurves(Curves=edges.Naked, Preserve=False)  # disabled
runion = RegionUnion(Curves=flatten(ribbon_3))  # disabled
offcrv = OffsetCurve(Curve=recrvdom.Remapped, Plane=PlaneXY(0, 0, 0), Distance=merge_4, BothSides=neg, Kinks=3, CapType=2)  # disabled
dom_2 = ConstructDomain(DomainStart=0, DomainEnd=1)  # disabled
crv_4 = Curve(graft(runion))  # disabled
boundary_3 = BoundarySurfaces(Edges=offcrv)  # disabled
recrvdom_2 = RemapCurveDomain(Curve=crv_4, Domain=dom_2)  # -> Remapped, Original, New; disabled
boundary_curve = Curve(join_2)  # disabled
fmerge = MergeFaces(Brep=boundary_3)  # -> Breps, Before, After; disabled
eval_7 = EvaluateCurve(Curve=recrvdom_2.Remapped, Parameter=0.5)  # -> Point, Tangent, Angle; disabled
join_3 = JoinCurves(Curves=boundary_curve, Preserve=False)  # disabled
incurve = PointInCurve(Point=eval_7.Point, Curve=join_3)  # -> Relationship, Point; disabled
number_slider_10 = Slider(7.8, range=0..15)  # disabled
equals_6 = Equality(FirstNumber=incurve.Relationship, SecondNumber=0)  # -> Equality, Inequality; disabled
cull_7 = CullPattern(List=recrvdom_2.Remapped, CullPattern=equals_6.Inequality)  # disabled
neg_2 = Negative(Value=number_slider_10)  # disabled
clean = CleanTree(RemoveNulls=True, RemoveInvalid=True, RemoveEmpty=True, Tree=cull_7)  # disabled
offcrv_2 = OffsetCurve(Plane=PlaneXY(0, 0, 0), Distance=neg_2, BothSides=0, Kinks=0, CapType=1)  # disabled
redpline_2 = Reduce(Polyline=clean, Tolerance=3)  # -> Polyline, Reduction; disabled
offset = OffsetCurve(Curve=redpline_2.Polyline, Distance=neg_2)  # disabled
polyoffset = PolylineOffset(
    Polylines=redpline_2.Polyline,
    Distance=number_slider_10,
    Plane=Plane(origin=(0, 0, 0), x=(0, 0, 0), y=(0, 0, 0)),
    Tolerance=0.001,
    ClosedFillet=1,
    OpenFillet=1,
    Miter=2)  # -> Contour, Holes; disabled
offcrv_3 = OffsetCurve(Curve=offset, Plane=PlaneXY(0, 0, 0), Distance=number_slider_10, BothSides=0, Kinks=0, CapType=1)  # -> simplify(Offset); disabled
# Multi-width Street Section (WIP)
crv_5 = Curve(clean)  # disabled
offset_2 = OffsetCurve(Curve=offset, Distance=number_slider_10, Corners=1)  # disabled
crv_6 = Curve(polyoffset.Holes)  # disabled
clean_2 = CleanTree(RemoveNulls=True, RemoveInvalid=True, RemoveEmpty=True, Tree=offcrv_3)  # disabled
explode_4 = Explode(Curve=crv_6, Recursive=True)  # -> Segments, Vertices; disabled
number_slider_11 = Slider(4.31, range=0..5)  # disabled
crv_7 = Curve([clean_2, join_3])  # disabled
len_3 = Length(Curve=explode_4.Segments)  # disabled
boundary_4 = BoundarySurfaces(Edges=flatten(crv_7))  # disabled
smaller_3 = SmallerThan(FirstNumber=len_3, SecondNumber=number_slider_11)  # -> SmallerThan, OrEqualTo; disabled
dispatch_7 = Dispatch(List=explode_4.Segments, DispatchPattern=smaller_3.SmallerThan)  # -> ListA, ListB; disabled
panel = Panel("1")  # disabled
crv_8 = Curve(dispatch_7.ListB)  # disabled
panel_2 = Panel("-1")  # disabled
shift_3 = ShiftList(List=crv_8, Shift=panel, Wrap=True)  # disabled
shift_4 = ShiftList(List=crv_8, Shift=panel_2, Wrap=True)  # disabled
pshift_3 = ShiftPaths(Data=shift_3, Offset=-1)  # disabled
pshift_4 = ShiftPaths(Data=shift_4, Offset=-1)  # disabled
llx_3 = LineLine(Line1=graft(crv_8), Line2=graft(pshift_4))  # -> ParamA, ParamB, PointA, PointB; disabled
llx_4 = LineLine(Line1=graft(pshift_3), Line2=graft(crv_8))  # -> ParamA, ParamB, PointA, PointB; disabled
eval_8 = EvaluateCurve(Curve=graft(crv_8), Parameter=0.5)  # -> Point, Tangent, Angle; disabled
eval_9 = EvaluateCurve(Curve=graft(pshift_4), Parameter=0.5)  # -> Point, Tangent, Angle; disabled
eval_10 = EvaluateCurve(Curve=graft(crv_8), Parameter=0.5)  # -> Point, Tangent, Angle; disabled
eval_11 = EvaluateCurve(Curve=graft(pshift_3), Parameter=0.5)  # -> Point, Tangent, Angle; disabled
avr_6 = Average(Input=[eval_8.Point, eval_9.Point])  # disabled
avr_7 = Average(Input=[eval_10.Point, eval_11.Point])  # disabled
nullrep_4 = ReplaceNulls(Items=llx_3.PointA, Replacements=avr_6)  # -> Items, Count; disabled
nullrep_5 = ReplaceNulls(Items=llx_4.PointA, Replacements=avr_7)  # -> Items, Count; disabled
ln_4 = Line(StartPoint=nullrep_4.Items, EndPoint=nullrep_5.Items)  # -> simplify(Line); disabled
trim = TrimTree(Tree=ln_4, Depth=1)  # disabled
number_slider_12 = Slider(5, range=0..10)  # disabled
join_4 = JoinCurves(Curves=trim, Preserve=False)  # disabled
offset_3 = OffsetCurve(Curve=join_4, Distance=number_slider_10, Corners=1)  # disabled
boundary_5 = BoundarySurfaces(Edges=offset_3)  # disabled

pipeline_4 = GeometryPipeline(
    GroupByLayer=False,
    GroupByType=False,
    IncludeHidden=True,
    IncludeLocked=True,
    LayerFilter="*Context::Car Network",
    NameFilter="*",
    SublayerFiltering=True,
    TypeFilter=4)
pipeline_5 = GeometryPipeline(
    GroupByLayer=False,
    GroupByType=False,
    IncludeHidden=True,
    IncludeLocked=True,
    LayerFilter="*BakedGeometry::SpaceSyntax",
    NameFilter="*",
    SublayerFiltering=True,
    TypeFilter=4)
flatten_5 = FlattenTree(Tree=pipeline_5, Path="{0}")
explode_5 = Explode(Curve=pipeline_4, Recursive=True)  # -> flatten(Segments), Vertices
number_slider_13 = Slider(4.4, range=0..10)
merge_5 = Merge(Data1=explode_5.Segments, Data2=flatten_5)  # -> flatten(Result)

# ----
# Testing Network Analysis (WIP)
# Routing Algorithm.
_1_process_geometry_2 = _1ProcessGeometry(Path=flatten_5, SegmentLength=10000)  # -> Object, Segments, Vectors, Ids
_2_build_graph_2 = _2BuildGraph(
    Object=_1_process_geometry_2.Object,
    LengthCoefficient=0,
    AngularCoefficient=1,
    AdditionalEdgeWeightCoefficient=0,
    CalculateDegree=False,
    CalculateInverseGraph=False,
    CopyObject=True)  # -> Object, InverseGraphEdges, Vertices, ReferencedEdges, DegreeCentrality
pt_2 = Point(Point(1130.426415, 2293.869698, 0))  # disabled
pt_3 = Point(Point(1321.271421, 1882.609424, 0))  # disabled
_3_shortest_path_dijkstra = _3ShortestDijkstra(Object=_2_build_graph_2.Object, Origins=pt_2, Destinations=pt_3, UseGeneratedPath=False)  # disabled
item_2 = ListItem(List=_1_process_geometry_2.Segments, Index=_3_shortest_path_dijkstra, Wrap=True)  # disabled
line = Line(item_2)  # disabled
swatch = ColourSwatch(SwatchColor=RGB(10, 255, 255))  # disabled
previewlw_2 = CustomPreviewLineweights(Geometry=line, Shader=swatch, Thickness=5, Absolute=False)  # disabled

# ----
# Testing Network Analysis (WIP)
# Routing Algorithm.
_1_process_geometry_3 = _1ProcessGeometry(Path=merge_5, SegmentLength=10000)  # -> Object, Segments, Vectors, Ids
_2_build_graph_3 = _2BuildGraph(
    Object=_1_process_geometry_3.Object,
    LengthCoefficient=0,
    AngularCoefficient=1,
    AdditionalEdgeWeightCoefficient=0,
    CalculateDegree=False,
    CalculateInverseGraph=False,
    CopyObject=True)  # -> Object, InverseGraphEdges, Vertices, ReferencedEdges, DegreeCentrality
pt_4 = Point(Point(1130.426415, 2293.869698, 0))  # disabled
pt_5 = Point(Point(1321.271421, 1882.609424, 0))  # disabled
_3_shortest_path_dijkstra_2 = _3ShortestDijkstra(Object=_2_build_graph_3.Object, Origins=pt_4, Destinations=pt_5, UseGeneratedPath=False)  # disabled
item_3 = ListItem(List=_1_process_geometry_3.Segments, Index=_3_shortest_path_dijkstra_2, Wrap=True)  # disabled
line_2 = Line(item_3)  # disabled
swatch_2 = ColourSwatch(SwatchColor=RGB(10, 255, 255))  # disabled
previewlw_3 = CustomPreviewLineweights(Geometry=line_2, Shader=swatch_2, Thickness=5, Absolute=False)  # disabled

_3_shortest_path_floyd_warshal_2 = _3ShortestFloydWarshal(Object=_2_build_graph_2.Object, CopyObject=True, IncludeMaA=False, UseGPU=False)
number_slider_14 = Slider(-5, range=-10..0)
_4_f_w_get_paths_2 = _4FWGetPaths(
    Object=_3_shortest_path_floyd_warshal_2,
    PairwiseShortestPaths=False,
    Radius=0,
    CopyObject=True,
    MaskInputString="00000011",
    PathInfoForPoints=False,
    UseGPU=False)  # -> BetweennessCentrality, ClosenessCentrality, Gravity, BetweennessCentralityWeighted, ClosenessCentralityWeighted, SupplementaryGeometry, PathsInformation
_3_shortest_path_floyd_warshal_3 = _3ShortestFloydWarshal(Object=_2_build_graph_3.Object, CopyObject=True, IncludeMaA=False, UseGPU=False)
ln_5 = NaturalLogarithm(Value=_4_f_w_get_paths_2.BetweennessCentrality)
_4_f_w_get_paths_3 = _4FWGetPaths(
    Object=_3_shortest_path_floyd_warshal_3,
    PairwiseShortestPaths=False,
    Radius=0,
    CopyObject=True,
    MaskInputString="00000011",
    PathInfoForPoints=False,
    UseGPU=False)  # -> BetweennessCentrality, ClosenessCentrality, Gravity, BetweennessCentralityWeighted, ClosenessCentralityWeighted, SupplementaryGeometry, PathsInformation
bnd_2 = Bounds(Numbers=ln_5)
dedomain = DeconstructDomain(Domain=bnd_2)  # -> Start, End
ln_6 = NaturalLogarithm(Value=_4_f_w_get_paths_3.BetweennessCentrality)
geo_5 = Geometry(_1_process_geometry_2.Segments)
bnd_3 = Bounds(Numbers=ln_6)
panel_3 = Panel(ln_6)
gradient_2 = Gradient(
    LowerLimit=dedomain.Start,
    UpperLimit=dedomain.End,
    Parameter=ln_5,
    stops=[0: RGB(234, 38, 0), 0.25: RGB(234, 126, 0), 0.5: RGB(254, 244, 84), 0.75: RGB(173, 203, 249), 1: RGB(75, 107, 169)])
dedomain_2 = DeconstructDomain(Domain=bnd_3)  # -> Start, End
geo_6 = Geometry(_1_process_geometry_3.Segments)
gradient_3 = Gradient(
    LowerLimit=dedomain_2.End,
    UpperLimit=dedomain_2.Start,
    Parameter=ln_6,
    stops=[0: RGB(234, 38, 0), 0.25: RGB(233, 150, 122), 0.5: RGB(254, 244, 84), 0.75: RGB(173, 203, 249), 1: RGB(75, 107, 169)])
previewlw_4 = CustomPreviewLineweights(Geometry=geo_5, Shader=gradient_2, Thickness=Slider(6, range=0..10), Absolute=True)
previewlw_5 = CustomPreviewLineweights(Geometry=geo_6, Shader=gradient_3, Thickness=Slider(8, range=0..10), Absolute=True)
Z = UnitZ(Factor=0.1)
Z_2 = UnitZ(Factor=0.05)
pipeline_6 = GeometryPipeline(
    GroupByLayer=False,
    GroupByType=False,
    IncludeHidden=True,
    IncludeLocked=True,
    LayerFilter="*Type-1",
    NameFilter="*",
    SublayerFiltering=True,
    TypeFilter=4)
number_slider_15 = Slider(3, range=0..10)  # disabled
Z_3 = UnitZ(Factor=number_slider_15)  # disabled
Z_4 = UnitZ(Factor=-1.5)  # disabled
number_slider_16 = Slider(2.1, range=1..3)  # disabled
swatch_3 = ColourSwatch(SwatchColor=RGBA(100, 125, 69, 98))
boundary_6 = BoundarySurfaces()  # disabled
boundary_7 = BoundarySurfaces()  # disabled

# ----
# La-Bobilla Topography constructor
path = FilePath("Z:\projects\45HUP EU Horizon Mission UP2030\gh\GH+Rhino\V2\Base-Geo\SRTM-Coordinates_AOI-2km.csv")
file = ReadFile(File=path, PerLineParse=True)  # disabled
panel_4 = Panel("1")  # disabled
split = SplitList(List=file, Index=panel_4)  # -> ListA, ListB; disabled
panel_5 = Panel(",")  # disabled
split_2 = TextSplit(Text=split.ListB, Separators=panel_5)  # disabled
panel_6 = Panel("1")  # disabled
panel_7 = Panel("2")  # disabled
panel_8 = Panel("0")  # disabled
number_slider_17 = Slider(1, range=0..1000)  # disabled
item_4 = ListItem(List=split_2, Index=panel_8, Wrap=True)  # -> flatten(Item); disabled
item_5 = ListItem(List=split_2, Index=panel_6, Wrap=True)  # -> flatten(Item); disabled
item_6 = ListItem(List=split_2, Index=panel_7, Wrap=True)  # -> flatten(Item); disabled
multiplication_5 = Multiplication(A=item_4, B=number_slider_17)  # disabled
multiplication_6 = Multiplication(A=item_5, B=number_slider_17)  # disabled
multiplication_7 = Multiplication(A=item_6, B=number_slider_17)  # disabled
pt_6 = ConstructPoint(XCoordinate=multiplication_6, YCoordinate=multiplication_7, ZCoordinate=multiplication_5)  # disabled
del = DelaunayMesh(Points=flatten(pt_6), Plane=PlaneXY(0, 0, 0))  # disabled
swatch_4 = ColourSwatch(SwatchColor=RGB(255, 217, 120))  # disabled
preview = CustomPreview(Geometry=del, Material=swatch_4)  # disabled

frontsetback = Slider(0, range=0..10)
number_slider_18 = Slider(15, range=0..100)

courtyard_permeability = Slider(0.59, range=0..1)
courtyard_permeability_2 = Slider(0.58, range=0..1)

Z_5 = UnitZ(Factor=0.5)
Z_6 = UnitZ(Factor=0.5)
pipeline_7 = GeometryPipeline(
    GroupByLayer=False,
    GroupByType=False,
    IncludeHidden=True,
    IncludeLocked=True,
    LayerFilter="*TrainLine",
    NameFilter="*",
    SublayerFiltering=True,
    TypeFilter=4)
Z_7 = UnitZ(Factor=2)
repeat = RepeatData()
splitmul = SplitBrepMultiple()

# ---- group: Topography
surface = Surface(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)

# ----
panel_efficiency_w_m_2 = Slider(200, range=0..1000)
division_3 = Division(A=panel_efficiency_w_m_2, B=1000)
kw_m_2 = Data(division_3)

# ----
# Green areas exclusion & definition
# extract spaces which do not intersect
# connects to 'Project' in Blocks & Parcels
# Connect to GreenSpace layer for Rhino input geometry (or pipeline)
# test for intersection w/ green spaces
# extract spaces which do intersect
# merge with small green spaces
# to plug-into tree generator
# Connect to Site Boundary geometry (or pipeline)
# Note: Do we want to have the green spaces manually defined prior to street network generation?
pipeline_8 = GeometryPipeline(
    GroupByLayer=False,
    GroupByType=False,
    IncludeHidden=True,
    IncludeLocked=True,
    LayerFilter="*ScenarioMax::Boundary",
    NameFilter="*",
    SublayerFiltering=True,
    TypeFilter=4)
pipeline_9 = GeometryPipeline(
    GroupByLayer=False,
    GroupByType=False,
    IncludeHidden=True,
    IncludeLocked=True,
    LayerFilter="*GreenSpace",
    NameFilter="*",
    SublayerFiltering=True,
    TypeFilter=4)
Z_8 = UnitZ(Factor=Slider(5, range=0..10))
boundary_8 = BoundarySurfaces(Edges=pipeline_9)
rev = Reverse(Vector=Z_8)
boundary_9 = BoundarySurfaces(Edges=expanded_boundary)
graft_4 = GraftTree(Tree=raw_blocks, IncludeEmptyLists=True, IncludeNullItems=True)
move = Move(Geometry=boundary_9, Motion=rev)  # -> Geometry, Transform
Z_9 = UnitZ(Factor=1)
boundary_10 = BoundarySurfaces(Edges=graft_4)  # -> flatten(Surfaces)
extr = Extrude(Base=boundary_8, Direction=rev)
extr_2 = Extrude(Base=move.Geometry, Direction=Z_9)
Z_10 = UnitZ(Factor=1)
cap = CapHoles(Brep=extr)  # -> simplify(flatten(Brep))
cap_2 = CapHoles(Brep=extr_2)  # -> simplify(flatten(Brep))
extr_3 = Extrude(Base=boundary_10, Direction=Z_10)
sunion = SolidUnion(Breps=[cap_2, cap])
shapein = ShapeInBrep(Brep=extr_3, Shape=sunion)
subtraction = Subtraction(A=shapein, B=1)
graft_5 = GraftTree(Tree=raw_blocks, IncludeEmptyLists=True, IncludeNullItems=True)  # -> simplify(Tree)
bool = Boolean(flatten(subtraction))
graft_6 = GraftTree(Tree=bool, IncludeEmptyLists=True, IncludeNullItems=True)  # -> simplify(Tree)
not = GateNot(A=bool)
cull_8 = CullPattern(List=graft_5, CullPattern=graft_6)
graft_7 = GraftTree(Tree=not, IncludeEmptyLists=True, IncludeNullItems=True)  # -> simplify(Tree)
flatten_6 = FlattenTree(Tree=cull_8, Path="{0}")
cull_9 = CullPattern(List=graft_5, CullPattern=graft_7)
flatten_7 = FlattenTree(Tree=cull_9, Path="{0}")

# ----
# Street Network Selection x Green Space
# Connects to 'SUnion' in 'Green Areas Exclusion & Definition'
# connects to 'Line Segments' in 'Clean Street Network Geometry'
# extract streets which do not intersect
# extract streets which do intersect
# could be useful for creating park paths
number_slider_19 = Slider(8, range=0..10)
graft_8 = GraftTree(Tree=street_network, IncludeEmptyLists=True, IncludeNullItems=True)
Z_11 = UnitZ(Factor=number_slider_19)
offcrv_4 = OffsetCurve(Curve=graft_8, Plane=PlaneXY(0, 0, 0), Distance=1, BothSides=0, Kinks=0, CapType=1)
boundary_11 = BoundarySurfaces(Edges=offcrv_4)
extr_4 = Extrude(Base=boundary_11, Direction=Z_11)
shapein_2 = ShapeInBrep(Brep=extr_4, Shape=sunion)
subtraction_2 = Subtraction(A=shapein_2, B=1)
graft_9 = GraftTree(Tree=street_network, IncludeEmptyLists=True, IncludeNullItems=True)  # -> simplify(Tree)
bool_2 = Boolean(subtraction_2)
not_2 = GateNot(A=bool_2)
graft_10 = GraftTree(Tree=not_2, IncludeEmptyLists=True, IncludeNullItems=True)  # -> simplify(Tree)
graft_11 = GraftTree(Tree=bool_2, IncludeEmptyLists=True, IncludeNullItems=True)  # -> simplify(Tree)
cull_10 = CullPattern(List=graft_9, CullPattern=graft_10)
cull_11 = CullPattern(List=graft_9, CullPattern=graft_11)
flatten_8 = FlattenTree(Tree=cull_10, Path="{0}")
flatten_9 = FlattenTree(Tree=cull_11, Path="{0}")
geo_7 = Geometry(flatten_9)
geo_8 = Geometry(flatten_8)
previewlw_6 = CustomPreviewLineweights(Geometry=geo_8, Shader=ColourSwatch(SwatchColor=RGB(44, 150, 35)), Thickness=Slider(4.8, range=0..10), Absolute=False)
previewlw_7 = CustomPreviewLineweights(Geometry=geo_7, Shader=ColourSwatch(SwatchColor=RGB(92, 12, 12)), Thickness=Slider(7, range=0..10), Absolute=False)

# ----
# Small Parcel Pocket Parks
number_slider_20 = Slider(3200, range=0..10000)
area = Area(Geometry=flatten_6)  # -> Area, Centroid
smaller_4 = SmallerThan(FirstNumber=area.Area, SecondNumber=number_slider_20)  # -> SmallerThan, OrEqualTo
not_3 = GateNot(A=smaller_4.SmallerThan)
cull_12 = CullPattern(List=flatten_6, CullPattern=smaller_4.SmallerThan)
xy_2 = XYPlane(Origin=Point(0, 0, 0))
cull_13 = CullPattern(List=flatten_6, CullPattern=not_3)  # -> flatten(List)
offset_4 = OffsetCurve(Curve=cull_12, Distance=Slider(-7, range=-10..0), Plane=xy_2, Corners=1)
pcol = PolylineCollapse(Polyline=offset_4, Tolerance=1)  # -> Polyline, Count
simplify = SimplifyCurve(Curve=pcol.Polyline)  # -> Curve, Simplified
geo_9 = Geometry(simplify(graft(cull_13)))
boundary_12 = BoundarySurfaces(Edges=simplify.Curve)

geo_10 = Geometry(flatten_7)

boundary_13 = BoundarySurfaces(Edges=geo_10)

# ----
# Simple Offset
number_slider_21 = Slider(6, range=0..10)
xy_3 = XYPlane(Origin=Point(0, 0, 0))
geo_11 = Geometry(geo_10)
offset_5 = OffsetCurve(Curve=geo_11, Distance=number_slider_21, Plane=xy_3, Corners=1)
pcol_2 = PolylineCollapse(Polyline=offset_5, Tolerance=1)  # -> Polyline, Count
simplify_2 = SimplifyCurve(Curve=pcol_2.Polyline)  # -> Curve, Simplified
boundary_14 = BoundarySurfaces(Edges=simplify_2.Curve)

geo_12 = Geometry(geo_7)
geo_13 = Geometry([boundary_12, boundary_13])

# ----
# Green Area Preview
number_slider_22 = Slider(3, range=0..10)
swatch_5 = ColourSwatch(SwatchColor=RGB(58, 87, 23))
preview_2 = CustomPreview(Geometry=geo_13, Material=swatch_5)
previewlw_8 = CustomPreviewLineweights(Geometry=simplify.Curve, Shader=swatch_5, Thickness=number_slider_22, Absolute=False)

offset_int_2 = OffsetIntersection(Curves=flatten(geo_7), InOffset=number_slider_13)  # -> Outer, Inner

# ----
# Testing Network Analysis (WIP)
# Routing Algorithm.
_1_process_geometry_4 = _1ProcessGeometry(Path=geo_12, SegmentLength=10000)  # -> Object, Segments, Vectors, Ids
_2_build_graph_4 = _2BuildGraph(
    Object=_1_process_geometry_4.Object,
    LengthCoefficient=0,
    AngularCoefficient=1,
    AdditionalEdgeWeightCoefficient=0,
    CalculateDegree=False,
    CalculateInverseGraph=False,
    CopyObject=True)  # -> Object, InverseGraphEdges, Vertices, ReferencedEdges, DegreeCentrality
pt_7 = Point(Point(1130.426415, 2293.869698, 0))  # disabled
pt_8 = Point(Point(1321.271421, 1882.609424, 0))  # disabled
_3_shortest_path_dijkstra_3 = _3ShortestDijkstra(Object=_2_build_graph_4.Object, Origins=pt_7, Destinations=pt_8, UseGeneratedPath=False)  # disabled
item_7 = ListItem(List=_1_process_geometry_4.Segments, Index=_3_shortest_path_dijkstra_3, Wrap=True)  # disabled
line_3 = Line(item_7)  # disabled
swatch_6 = ColourSwatch(SwatchColor=RGB(10, 255, 255))  # disabled
previewlw_9 = CustomPreviewLineweights(Geometry=line_3, Shader=swatch_6, Thickness=5, Absolute=False)  # disabled

geo_14 = Geometry(offset_int_2.Inner)

# ----
# Street Trees
# Low Poly Tree Constructor
neg_3 = Negative(Value=number_slider_13)
offcrv_5 = OffsetCurve(Curve=geo_7, Plane=PlaneXY(0, 0, 0), Distance=number_slider_13, BothSides=neg_3, Kinks=0, CapType=0)
len_4 = Length(Curve=offcrv_5)
division_4 = Division(A=len_4, B=Slider(20, range=0..100))
round = Round(Number=division_4)  # -> Nearest, Floor, Ceiling
divide = DivideCurve(Curve=offcrv_5, Count=round.Nearest, Kinks=False)  # -> Points, Tangents, Parameters
lng_4 = ListLength(List=divide.Parameters)
subtraction_3 = Subtraction(A=lng_4, B=1)
x_minus_one = XMinusOne(NumberX=subtraction_3)
item_8 = ListItem(List=divide.Parameters, Index=x_minus_one, Wrap=True)
item_9 = ListItem(List=divide.Parameters, Index=subtraction_3, Wrap=True)
item_10 = ListItem(List=divide.Parameters, Index=Slider(1, range=0..1), Wrap=True)
division_5 = Division(A=item_10, B=2)
multiplication_8 = Multiplication(A=item_10, B=0)
addition = Addition(A=item_9, B=item_8)
replace_2 = ReplaceItems(List=divide.Parameters, Item=division_5, Indices=multiplication_8, Wrap=False)
division_6 = Division(A=addition, B=2)
crv_9 = Curve(simplify(graft(offcrv_5)))
replace_3 = ReplaceItems(List=replace_2, Item=division_6, Indices=subtraction_3, Wrap=False)  # -> simplify(List)
eval_12 = EvaluateCurve(Curve=crv_9, Parameter=replace_3)  # -> Point, Tangent, Angle
number_slider_23 = Slider(271587.543, range=0..1000000)
pt_9 = Point(eval_12.Point)
lng_5 = ListLength(List=pt_9)
random = Random(Range=Domain(0, 1), Number=lng_5, Seed=number_slider_23)  # -> graft(Random)
dom_3 = ConstructDomain(DomainStart=Slider(3, range=0..1200), DomainEnd=Slider(5, range=0..1200))
dom_4 = ConstructDomain(DomainStart=Slider(2, range=0..1200), DomainEnd=Slider(4, range=0..1200))
dom_5 = ConstructDomain(DomainStart=Slider(3, range=3..15), DomainEnd=Slider(12, range=3..30))
remap_2 = RemapNumbers(Value=random, Source=Domain(0, 1), Target=[dom_3, dom_4, dom_5])  # -> simplify(Mapped), Clipped
item_11 = ListItem(List=remap_2.Mapped, Index=0, Wrap=True)  # -> Item, Item1, Item2
multiplication_9 = Multiplication(A=item_11.Item, B=1.5)
Z_12 = UnitZ(Factor=multiplication_9)
move_2 = Move(Geometry=graft(pt_9), Motion=Z_12)  # -> Geometry, Transform
cyl = Cylinder(Base=graft(pt_9), Radius=expr("x/20", item_11.Item), Length=multiplication_9)
box = CenterBox(Base=move_2.Geometry, X=item_11.Item1, Y=item_11.Item1, Z=item_11.Item1)
pop3d = Populate3D(Region=box, Count=item_11.Item2, Seed=number_slider_23)  # -> simplify(Population)
facet = FacetDome(Points=pop3d)  # -> Pattern, Dome
boundary_15 = BoundarySurfaces(Edges=facet.Pattern)
join_5 = BrepJoin(Breps=boundary_15)  # -> Breps, Closed
sint = SolidIntersection(BrepsA=graft(box), BrepsB=graft(join_5.Breps))  # -> flatten(Result)
Z_13 = UnitZ(Factor=Slider(3, range=0..10))
move_3 = Move(Geometry=sint, Motion=Z_13)  # -> Geometry, Transform
previewmat = CustomPreviewMaterials(Geometry=cyl, DiffuseColor=ColourSwatch(SwatchColor=RGB(110, 81, 59)), Transparency=Slider(0, range=0..1))

explode_6 = Explode(Curve=geo_14, Recursive=True)  # -> Segments, Vertices
len_5 = Length(Curve=explode_6.Segments)
larger = LargerThan(FirstNumber=len_5, SecondNumber=10)  # -> LargerThan, OrEqualTo
_3_shortest_path_floyd_warshal_4 = _3ShortestFloydWarshal(Object=_2_build_graph_4.Object, CopyObject=True, IncludeMaA=False, UseGPU=False)
cull_14 = CullPattern(List=explode_6.Segments, CullPattern=larger.LargerThan)
_4_f_w_get_paths_4 = _4FWGetPaths(
    Object=_3_shortest_path_floyd_warshal_4,
    PairwiseShortestPaths=False,
    Radius=0,
    CopyObject=True,
    MaskInputString="00000011",
    PathInfoForPoints=False,
    UseGPU=False)  # -> BetweennessCentrality, ClosenessCentrality, Gravity, BetweennessCentralityWeighted, ClosenessCentralityWeighted, SupplementaryGeometry, PathsInformation
ext = ExtendCurve(Curve=cull_14, Type=0, Start=number_slider_14, End=number_slider_14)
ln_7 = NaturalLogarithm(Value=_4_f_w_get_paths_4.BetweennessCentrality)
bnd_4 = Bounds(Numbers=ln_7)
ribbon_4 = Ribbon(Curves=ext, Distance=Slider(1.2, range=0..5), Union=False)
dedomain_3 = DeconstructDomain(Domain=bnd_4)  # -> Start, End
geo_15 = Geometry(_1_process_geometry_4.Segments)
boundary_16 = BoundarySurfaces(Edges=ribbon_4)  # -> simplify(Surfaces)
gradient_4 = Gradient(
    LowerLimit=dedomain_3.Start,
    UpperLimit=dedomain_3.End,
    Parameter=ln_7,
    stops=[0: RGB(234, 38, 0), 0.25: RGB(234, 126, 0), 0.5: RGB(254, 244, 84), 0.75: RGB(173, 203, 249), 1: RGB(75, 107, 169)])
polyoffset_2 = PolylineOffset(
    Polylines=ribbon_4,
    Distance=Slider(0.14, range=0..0.15),
    Plane=Plane(origin=(0, 0, 0), x=(0, 0, 0), y=(0, 0, 0)),
    Tolerance=0.001,
    ClosedFillet=1,
    OpenFillet=1,
    Miter=2)  # -> Contour, Holes
crv_10 = Curve(simplify(graft(polyoffset_2.Holes)))
graft_12 = GraftTree(Tree=ribbon_4, IncludeEmptyLists=True, IncludeNullItems=True)  # -> simplify(Tree)
project = Project(Geometry=crv_10, Plane=PlaneXY(0, 0, 0))  # -> Geometry, Transform
project_2 = Project(Geometry=graft_12, Plane=PlaneXY(0, 0, 0))  # -> Geometry, Transform
previewlw_10 = CustomPreviewLineweights(Geometry=geo_15, Shader=gradient_4, Thickness=Slider(8, range=0..10), Absolute=True)
boundary_17 = BoundarySurfaces(Edges=[project_2.Geometry, project.Geometry])
merge_6 = Merge(Data1=project_2.Geometry, Data2=project.Geometry)  # -> simplify(Result)
boundary_18 = BoundarySurfaces(Edges=project.Geometry)
boundary_19 = BoundarySurfaces(Edges=project_2.Geometry)
boundary_20 = BoundarySurfaces(Edges=merge_6)
sdiff = SolidDifference(BrepsA=boundary_19, BrepsB=boundary_18)
extr_5 = Extrude(Base=boundary_18, Direction=Z)
extr_6 = Extrude(Base=boundary_20, Direction=Z_2)
area_2 = Area(Geometry=boundary_19)  # -> Area, Centroid

cap_3 = CapHoles(Brep=extr_5)
cap_4 = CapHoles(Brep=extr_6)

previewmat_2 = CustomPreviewMaterials(Geometry=cap_3, DiffuseColor=ColourSwatch(SwatchColor=RGB(93, 120, 36)))
previewmat_3 = CustomPreviewMaterials(Geometry=cap_4, DiffuseColor=ColourSwatch(SwatchColor=RGB(255, 255, 255)))
flatten_10 = FlattenTree(Tree=cyl, Path="{0}")  # -> graft(Tree)
panel_9 = Panel(flatten_10)
edges_2 = BrepEdges(Brep=move_3.Geometry)  # -> Naked, Interior, NonManifold
previewlw_11 = CustomPreviewLineweights(Geometry=move_3.Geometry, Shader=swatch_3, Absolute=False)
graft_13 = GraftTree(Tree=move_3.Geometry, IncludeEmptyLists=True, IncludeNullItems=True)
group = Group(Objects=[flatten_10, graft_13])

# ---- group: Trees
geometry = Geometry(flatten_10)

# ----
ma = MassAddition(Input=flatten(area_2.Area))  # -> Result, PartialResults
total_bioswale_area_m_2 = Panel(ma.Result)

# ----
# Street Sections
# Connects to fillet
# radius of buildings
# Sidewalk
# Connects to street width
# (block offset)
# Bike lanes
# Curb separating the bikelane
# Street Surface
street_wall_offset = Slider(-9, range=-15..0)
sidewalk_depth = Slider(5, range=0..15)
abs = Absolute(Value=street_wall_offset)
offset_int_3 = OffsetIntersection(Curves=flatten(geo_7), InOffset=sidewalk_depth, CornerType=2)  # -> Outer, Inner
offset_int_4 = OffsetIntersection(Curves=flatten(geo_7), InOffset=Slider(3.6, range=0..10), CornerType=Slider(2, range=1..4))  # -> Outer, Inner
offset_int_5 = OffsetIntersection(Curves=flatten(geo_7), InOffset=Slider(3.8, range=0..10), CornerType=2)  # -> Outer, Inner
offset_int_6 = OffsetIntersection(Curves=flatten(geo_7), InOffset=abs, CornerType=Slider(2, range=1..4))  # -> Outer, Inner
merge_7 = Merge(Data1=offset_int_3.Outer, Data2=offset_int_3.Inner)  # -> flatten(Result)
merge_8 = Merge(Data1=offset_int_4.Outer, Data2=offset_int_4.Inner)  # -> flatten(Result)
merge_9 = Merge(Data1=offset_int_5.Outer, Data2=offset_int_5.Inner)  # -> flatten(Result)
merge_10 = Merge(Data1=offset_int_6.Outer, Data2=offset_int_6.Inner)  # -> flatten(Result)
fillet = FilletDistance(Curve=merge_7, Distance=Slider(3, range=0..10))
fil_cham = FilletChamfer()
fillet_2 = FilletDistance(Curve=merge_8, Distance=Slider(3, range=0..10))
fillet_3 = FilletDistance(Curve=merge_9, Distance=Slider(3, range=0..10))
boundary_21 = BoundarySurfaces(Edges=fillet_2)
boundary_22 = BoundarySurfaces(Edges=fillet)
boundary_23 = BoundarySurfaces(Edges=fillet_3)
sdiff_2 = SolidDifference(BrepsA=boundary_22, BrepsB=boundary_23)  # -> graft(Result)
sdiff_3 = SolidDifference(BrepsA=boundary_22, BrepsB=boundary_23)
sdiff_4 = SolidDifference(BrepsA=boundary_22, BrepsB=boundary_21)  # -> graft(Result)
sidewalk_height = Slider(0.2, range=0..1)
sdiff_5 = SolidDifference(BrepsA=sdiff_4, BrepsB=sdiff_2)
Z_14 = UnitZ(Factor=sidewalk_height)
Z_15 = UnitZ(Factor=Slider(0.1, range=0..1))
extr_7 = Extrude(Base=sdiff_5, Direction=Z_15)
previewmat_4 = CustomPreviewMaterials(Geometry=boundary_21, DiffuseColor=ColourSwatch(SwatchColor=RGB(204, 165, 165)))
previewmat_5 = CustomPreviewMaterials(Geometry=extr_7, DiffuseColor=ColourSwatch(SwatchColor=RGB(255, 255, 255)))
previewmat_6 = CustomPreviewMaterials(Geometry=sdiff_3, DiffuseColor=ColourSwatch(SwatchColor=RGB(224, 200, 200)))

# ----
# Blocks
project_3 = Project(Geometry=geo_9, Plane=PlaneXY(0, 0, 0))  # -> Geometry, Transform
reparamcrv = ReparameterizeCurve(Curve=project_3.Geometry)  # -> Reparameterized, Original
redpline_3 = Reduce(Polyline=reparamcrv.Reparameterized, Tolerance=1)  # -> Polyline, Reduction
abs_2 = Absolute(Value=street_wall_offset)
polyoffset_blocks = PolylineOffset(
    Polylines=redpline_3.Polyline,
    Distance=abs_2,
    Plane=Plane(origin=(0, 0, 0), x=(0, 0, 0), y=(0, 0, 0)),
    Tolerance=0.001,
    ClosedFillet=1,
    OpenFillet=1,
    Miter=2)  # -> Contour, Holes

# ----
# Intersection Identification (WIP)
number_slider_24 = Slider(5.1, range=0..10)  # disabled
mcx = MultipleCurves(Curves=geo_7)  # -> Points, IndexA, IndexB, ParamA, ParamB; disabled
number_slider_25 = Slider(2, range=1..4)  # disabled
offset_int_7 = OffsetIntersection(Curves=flatten(geo_7), InOffset=number_slider_24, CornerType=number_slider_25)  # -> Outer, Inner; disabled
cir_2 = Circle(Plane=mcx.Points, Radius=number_slider_24)  # disabled
cir_3 = Circle(Plane=mcx.Points, Radius=abs)  # -> graft(Circle); disabled
merge_11 = Merge(Data1=offset_int_7.Outer, Data2=offset_int_7.Inner)  # -> flatten(Result); disabled
crv_11 = Curve(offset_int_7.Inner)  # disabled
explode_7 = Explode(Curve=merge_11, Recursive=True)  # -> Segments, Vertices; disabled
pt_10 = Point(flatten(explode_7.Vertices))  # disabled
incurve_2 = PointInCurve(Point=pt_10, Curve=cir_3)  # -> Relationship, Point; disabled
equals_7 = Equality(FirstNumber=incurve_2.Relationship, SecondNumber=2)  # -> Equality, Inequality; disabled
cull_15 = CullPattern(List=incurve_2.Point, CullPattern=equals_7.Equality)  # disabled
crossref = CrossReference(ListA=cull_15, ListB=cull_15, CrossMode=1)  # -> ListA, ListB; disabled
ln_8 = Line(StartPoint=crossref.ListA, EndPoint=crossref.ListB)  # disabled

addition_2 = Addition(A=abs, B=4)  # disabled
blocks = Geometry(polyoffset_blocks.Holes)
polygon = Polygon(Plane=mcx.Points, Radius=addition_2, Segments=4, FilletRadius=0)  # -> Polygon, Length; disabled
cir_4 = Circle(Plane=mcx.Points, Radius=addition_2)  # -> graft(Circle); disabled
boundary_24 = BoundarySurfaces(Edges=cir_4)  # disabled
rotate = Rotate(Geometry=polygon.Polygon, Angle=degrees(45), Plane=mcx.Points)  # -> Geometry, Transform; disabled
extr_8 = Extrude(Base=boundary_24, Direction=Z_3)  # disabled
move_4 = Move(Geometry=extr_8, Motion=Z_4)  # -> flatten(Geometry), Transform; disabled
sunion_2 = SolidUnion(Breps=flatten([cap_2, move_4.Geometry]))  # disabled
panel_10 = Panel(move_4.Geometry)  # disabled
sdiff_6 = SolidDifference(BrepsA=extr_7, BrepsB=move_4.Geometry)  # disabled

# ----
# Typology Spliting Definition
Z_16 = UnitZ(Factor=5)
boundary_25 = BoundarySurfaces(Edges=pipeline_6)
rev_2 = Reverse(Vector=Z_16)
boundary_26 = BoundarySurfaces(Edges=expanded_boundary)
graft_14 = GraftTree(Tree=polyoffset_blocks.Holes, IncludeEmptyLists=True, IncludeNullItems=True)
move_5 = Move(Geometry=boundary_26, Motion=rev_2)  # -> Geometry, Transform
Z_17 = UnitZ(Factor=1)
boundary_27 = BoundarySurfaces(Edges=graft_14)  # -> flatten(Surfaces)
extr_9 = Extrude(Base=boundary_25, Direction=rev_2)
extr_10 = Extrude(Base=move_5.Geometry, Direction=Z_17)
Z_18 = UnitZ(Factor=1)
cap_5 = CapHoles(Brep=extr_9)  # -> simplify(flatten(Brep))
cap_6 = CapHoles(Brep=extr_10)  # -> simplify(flatten(Brep))
extr_11 = Extrude(Base=boundary_27, Direction=Z_18)
sunion_3 = SolidUnion(Breps=[cap_6, cap_5])
shapein_3 = ShapeInBrep(Brep=extr_11, Shape=sunion_3)
subtraction_4 = Subtraction(A=shapein_3, B=1)
graft_15 = GraftTree(Tree=polyoffset_blocks.Holes, IncludeEmptyLists=True, IncludeNullItems=True)  # -> simplify(Tree)
bool_3 = Boolean(flatten(subtraction_4))
graft_16 = GraftTree(Tree=bool_3, IncludeEmptyLists=True, IncludeNullItems=True)  # -> simplify(Tree)
not_4 = GateNot(A=bool_3)
cull_16 = CullPattern(List=graft_15, CullPattern=graft_16)
graft_17 = GraftTree(Tree=not_4, IncludeEmptyLists=True, IncludeNullItems=True)  # -> simplify(Tree)
flatten_11 = FlattenTree(Tree=cull_16, Path="{0}")
cull_17 = CullPattern(List=graft_15, CullPattern=graft_17)
flatten_12 = FlattenTree(Tree=cull_17, Path="{0}")
geo_16 = Geometry(simplify(graft(flatten_12)))
geo_17 = Geometry(simplify(graft(flatten_11)))

brec = BoundingRectangle(Geometry=cull_15, Plane=PlaneXY(0, 0, 0), Axis=0, Slide=0, Union=True)  # -> Bounding, DimensionX, DimensionY; disabled
pcen = PolygonCenter(Polyline=brec.Bounding)  # -> CenterV, CenterE, CenterA; disabled
scale = Scale(Geometry=brec.Bounding, Center=pcen.CenterE, Factor=number_slider_16)  # -> Geometry, Transform; disabled
area_3 = Area(Geometry=blocks)  # -> Area, Centroid
ma_2 = MassAddition(Input=flatten(area_3.Area))  # -> Result, PartialResults

# ----
# Park Trees
# Low Poly Tree Constructor
brep = Brep(boundary_14)
edges_3 = BrepEdges(Brep=brep)  # -> Naked, Interior, NonManifold
xy_4 = XYPlane(Origin=Point(0, 0, 0))
crv_12 = Curve(edges_3.Naked)
join_6 = JoinCurves(Curves=crv_12, Preserve=False)
project_4 = Project(Geometry=join_6, Plane=xy_4)  # -> Geometry, Transform
edge_offset = Slider(0, range=0..20)
random_unit_position = Slider(37, range=0..100)
crv_13 = Curve(project_4.Geometry)
offset_6 = OffsetCurve(Curve=crv_13, Distance=edge_offset, Plane=xy_4, Corners=1)  # -> flatten(Curve)
boundary_28 = BoundarySurfaces(Edges=offset_6)
Z_19 = UnitZ(Factor=1)
number_slider_26 = Slider(271587.543, range=0..1000000)
dom_6 = ConstructDomain(DomainStart=Slider(3, range=0..1200), DomainEnd=Slider(12, range=0..1200))
dom_7 = ConstructDomain(DomainStart=Slider(1, range=0..1200), DomainEnd=Slider(5, range=0..1200))
dom_8 = ConstructDomain(DomainStart=Slider(3, range=3..15), DomainEnd=Slider(10, range=3..30))
number_slider_27 = Slider(0.77, range=0..1)

area_4 = Area(Geometry=brep)  # -> flatten(Area), Centroid
area_5 = Area(Geometry=brep)  # -> flatten(Area), Centroid

# ----
# Number of trees
# / Area
of_units = Slider(40, range=0..100)
sqr = Square(Value=of_units)
integer_division = IntegerDivision(A=area_5.Area, B=sqr)

popgeo = PopulateGeometry(Geometry=boundary_28, Count=integer_division, Seed=random_unit_position)
project_5 = ProjectPoint(Point=popgeo, Direction=Z_19, Geometry=brep)  # -> Point, Index
ln_9 = Line(StartPoint=project_5.Point, EndPoint=popgeo)
pt_11 = Point(popgeo)
lng_6 = ListLength(List=pt_11)
random_2 = Random(Range=Domain(0, 1), Number=lng_6, Seed=number_slider_26)  # -> graft(Random)
remap_3 = RemapNumbers(Value=random_2, Source=Domain(0, 1), Target=[dom_6, dom_7, dom_8])  # -> simplify(Mapped), Clipped
item_12 = ListItem(List=remap_3.Mapped, Index=0, Wrap=True)  # -> Item, Item1, Item2
Z_20 = UnitZ(Factor=item_12.Item)
move_6 = Move(Geometry=graft(pt_11), Motion=Z_20)  # -> Geometry, Transform
cyl_2 = Cylinder(Base=graft(pt_11), Radius=expr("x/40", item_12.Item), Length=item_12.Item)
box_2 = CenterBox(Base=move_6.Geometry, X=item_12.Item1, Y=item_12.Item1, Z=item_12.Item1)
pop3d_2 = Populate3D(Region=box_2, Count=item_12.Item2, Seed=number_slider_26)  # -> simplify(Population)
facet_2 = FacetDome(Points=pop3d_2)  # -> Pattern, Dome
boundary_29 = BoundarySurfaces(Edges=facet_2.Pattern)
join_7 = BrepJoin(Breps=boundary_29)  # -> Breps, Closed
sint_2 = SolidIntersection(BrepsA=graft(box_2), BrepsB=graft(join_7.Breps))  # -> flatten(Result)
previewmat_7 = CustomPreviewMaterials(Geometry=cyl_2, DiffuseColor=ColourSwatch(SwatchColor=RGB(110, 81, 59)), Transparency=number_slider_27)

edges_4 = BrepEdges(Brep=sint_2)  # -> Naked, Interior, NonManifold
geo_18 = Geometry(sint_2)
previewmat_8 = CustomPreviewMaterials(Geometry=geo_18, DiffuseColor=RGBA(57, 105, 23, 94), Transparency=number_slider_27)
previewlw_12 = CustomPreviewLineweights(Geometry=[edges_4.Interior, edges_2.Naked], Shader=swatch_3, Absolute=False)
previewmat_9 = CustomPreviewMaterials(Geometry=move_3.Geometry, DiffuseColor=RGBA(57, 105, 23, 94), Transparency=number_slider_27)

# ----
# Type 1- Parcels, Block Typologies & Building Footprints
# (Optional!) Rounds or Chamfers Buildings
# For Typical Buildings Set Radius to 0
number_slider_28 = Slider(16, range=0..100)
parcels_2 = Parcels(Polygons=geo_17, ConnectionDistance=1, StreetOffset=0, PlotWidthThreshold=number_slider_28, Precision=100)
blocks_2 = Geometry(geo_17)
parcels_3 = Geometry(parcels_2)
frontsetback_2 = Slider(0, range=0..10)
clean_3 = CleanTree(RemoveNulls=True, RemoveInvalid=True, RemoveEmpty=True, Tree=parcels_3)  # -> simplify(Tree)
clean_4 = CleanTree(RemoveNulls=True, RemoveInvalid=True, RemoveEmpty=True, Tree=blocks_2)  # -> simplify(Tree)
number_slider_29 = Slider(15, range=0..100)
buildable = BuildableArea(
    Parcels=clean_3,
    Blocks=clean_4,
    RoadSetback=frontsetback_2,
    SideSetback=Slider(0, range=-10..0),
    BackSetback=3,
    Tolerance=0.7853981634)
number_slider_30 = Slider(0, range=0..10)
buildings = BuildingGeneration(
    BuildableArea=buildable,
    Parcels=clean_3,
    Blocks=clean_4,
    BuildingDepth=number_slider_29,
    BuildingLength=Slider(16, range=0..100),
    BuildingType=Slider(2, range=0..2),
    FAR=0,
    FloorHeight=4)  # -> BuildingFootprint, NumberOfFloors, BuildingHeight, FAR, GFA
polychamfil = PolylineFilletChamfer(Curve=buildings.BuildingFootprint, Radius=number_slider_30, Type=True, Direction=True)

fillet_4 = FilletDistance(Curve=merge_10, Distance=number_slider_30)
boundary_30 = BoundarySurfaces(Edges=fillet_4)
sdiff_7 = SolidDifference(BrepsA=boundary_30, BrepsB=boundary_22)
extr_12 = Extrude(Base=sdiff_7, Direction=Z_14)
sidewalk_edges = BrepEdges(Brep=extr_12)  # -> Naked, Interior, NonManifold
previewmat_10 = CustomPreviewMaterials(Geometry=extr_12, DiffuseColor=ColourSwatch(SwatchColor=RGB(255, 255, 255)))

area_6 = Area(Geometry=polychamfil)  # -> Area, Centroid
area_7 = Area(Geometry=polychamfil)  # -> Area, Centroid

larger_2 = LargerThan(FirstNumber=area_7.Area, SecondNumber=Slider(225, range=0..500))  # -> LargerThan, OrEqualTo
cull_18 = CullPattern(List=polychamfil, CullPattern=larger_2.LargerThan)
boundary_31 = BoundarySurfaces(Edges=cull_18)

# ----
# Type 2- Parcels, Block Typologies & Building Footprints
# (Optional!) Rounds or Chamfers Buildings
# For Typical Buildings Set Radius to 0
number_slider_31 = Slider(20, range=0..100)
parcels_4 = Parcels(Polygons=geo_16, ConnectionDistance=1, StreetOffset=0, PlotWidthThreshold=number_slider_31, Precision=100)
blocks_3 = Geometry(geo_16)
parcels_5 = Geometry(parcels_4)
clean_5 = CleanTree(RemoveNulls=True, RemoveInvalid=True, RemoveEmpty=True, Tree=parcels_5)  # -> simplify(Tree)
clean_6 = CleanTree(RemoveNulls=True, RemoveInvalid=True, RemoveEmpty=True, Tree=blocks_3)  # -> simplify(Tree)
buildable_2 = BuildableArea(
    Parcels=clean_5,
    Blocks=clean_6,
    RoadSetback=frontsetback,
    SideSetback=Slider(-2, range=-10..0),
    BackSetback=3,
    Tolerance=0.7853981634)
buildings_2 = BuildingGeneration(
    BuildableArea=buildable_2,
    Parcels=clean_5,
    Blocks=clean_6,
    BuildingDepth=number_slider_18,
    BuildingLength=Slider(20, range=0..100),
    BuildingType=2,
    FAR=0,
    FloorHeight=4)  # -> BuildingFootprint, NumberOfFloors, BuildingHeight, FAR, GFA
polychamfil_2 = PolylineFilletChamfer(Curve=buildings_2.BuildingFootprint, Radius=Slider(0, range=0..10), Type=True, Direction=True)

area_8 = Area(Geometry=polychamfil_2)  # -> Area, Centroid
area_9 = Area(Geometry=polychamfil_2)  # -> Area, Centroid

larger_3 = LargerThan(FirstNumber=area_9.Area, SecondNumber=Slider(225, range=0..500))  # -> LargerThan, OrEqualTo
cull_19 = CullPattern(List=polychamfil_2, CullPattern=larger_3.LargerThan)
boundary_32 = BoundarySurfaces(Edges=cull_19)

# ----
# Building Height Attractor
# Connects to Boundary Surfaces in 'Buildings'
# Connects to ftpt (Building Footprints) from Buildings Component in 'Buildings'
pipeline_10 = GeometryPipeline(
    GroupByLayer=False,
    GroupByType=False,
    IncludeHidden=True,
    IncludeLocked=True,
    LayerFilter="*KeyPoints",
    NameFilter="*",
    SublayerFiltering=True,
    TypeFilter=1)
cull_20 = CullPattern(List=buildings_2.BuildingFootprint, CullPattern=larger_3.LargerThan)
pcen_2 = PolygonCenter(Polyline=cull_20)  # -> CenterV, CenterE, simplify(flatten(CenterA))
pt_12 = Point(graft(pcen_2.CenterA))
dist_2 = Distance(PointA=pt_12, PointB=pipeline_10)
avr_8 = Average(Input=dist_2)
larger_4 = LargerThan(FirstNumber=dist_2, SecondNumber=avr_8)  # -> LargerThan, OrEqualTo
dispatch_8 = Dispatch(List=dist_2, DispatchPattern=larger_4.LargerThan)  # -> ListA, ListB
flatten_13 = FlattenTree(Tree=dispatch_8.ListA, Path="{0}")
bnd_5 = Bounds(Numbers=flatten_13)
dom_9 = ConstructDomain(DomainStart=Slider(1, range=0..1), DomainEnd=Slider(0, range=0..100))
remap_4 = RemapNumbers(Value=flatten_13, Source=bnd_5, Target=dom_9)  # -> Mapped, Clipped
eº = PowerOfE(Value=remap_4.Mapped)
bnd_6 = Bounds(Numbers=eº)
dom_10 = ConstructDomain(DomainStart=Slider(7, range=0..10), DomainEnd=Slider(13, range=0..100))
remap_5 = RemapNumbers(Value=eº, Source=bnd_6, Target=dom_10)  # -> flatten(Mapped), Clipped
culln = CullNth(List=boundary_32, CullFrequency=2)
flatten_14 = FlattenTree(Tree=culln, Path="{0}")
roundn = RoundToNearest(
    NumbersX=remap_5.Mapped,
    NumbersY=[4, 8, 12, 16, 20, 24, 28, 32, 36, 40, 44, 48, 52, 56, 60, 64, 68, 72, 76, 80, 84, 88, 92, 96, 100, 104, 108],
    RemapX=False)  # -> flatten(Nearest), Index, Difference, RemappedX
graft_18 = GraftTree(Tree=flatten_14, IncludeEmptyLists=True, IncludeNullItems=True)  # -> simplify(Tree)
graft_19 = GraftTree(Tree=roundn.Nearest, IncludeEmptyLists=True, IncludeNullItems=True)
Z_21 = UnitZ(Factor=graft_19)
extr_13 = Extrude(Base=graft_18, Direction=Z_21)
cap_7 = CapHoles(Brep=extr_13)  # -> simplify(Brep)
preview_3d_buildings = CustomPreview(Geometry=cap_7, Shader=ColourSwatch(SwatchColor=RGB(225, 225, 227)))

subtraction_5 = Subtraction(A=remap_5.Mapped, B=3)
addition_3 = Addition(A=remap_5.Mapped, B=3)
dom_11 = ConstructDomain(DomainStart=subtraction_5, DomainEnd=addition_3)  # -> graft(Domain)
index_3 = ItemIndex(List=flatten(dom_11), Item=flatten(dom_11))  # -> graft(Index)
random_3 = Random(Range=dom_11, Number=1, Seed=index_3)
roundn_2 = RoundToNearest(NumbersX=random_3, NumbersY=[4, 7, 10, 13, 16, 19, 22, 25, 28, 31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], RemapX=False)  # -> flatten(Nearest), Index, Difference, RemappedX
pdecon_3 = Deconstruct(Point=Z_21)  # -> XComponent, YComponent, ZComponent
edges_5 = BrepEdges(Brep=cap_7)  # -> Naked, Interior, NonManifold
previewlw_13 = CustomPreviewLineweights(
    Geometry=edges_5.Interior,
    Shader=ColourSwatch(SwatchColor=RGB(14, 24, 51)),
    Thickness=Slider(2.9, range=0..10),
    Absolute=False)
addition_4 = Addition(A=roundn_2.Index, B=1)  # disabled
no_floors = Panel(addition_4)  # disabled

# ----
# Courtyards
polyoffset_3 = PolylineOffset(
    Polylines=geo_17,
    Distance=number_slider_29,
    Plane=Plane(origin=(0, 0, 0), x=(0, 0, 0), y=(0, 0, 0)),
    Tolerance=0.001,
    ClosedFillet=1,
    OpenFillet=1,
    Miter=2)  # -> Contour, Holes
polyoffset_4 = PolylineOffset(
    Polylines=geo_16,
    Distance=number_slider_18,
    Plane=Plane(origin=(0, 0, 0), x=(0, 0, 0), y=(0, 0, 0)),
    Tolerance=0.001,
    ClosedFillet=1,
    OpenFillet=1,
    Miter=2)  # -> Contour, Holes
boundary_33 = BoundarySurfaces(Edges=polyoffset_3.Holes)
boundary_34 = BoundarySurfaces(Edges=polyoffset_4.Holes)
index_4 = ItemIndex(List=boundary_33, Item=boundary_33)
index_5 = ItemIndex(List=boundary_34, Item=boundary_34)
pow_4 = Power(A=index_4, B=0)
pow_5 = Power(A=index_5, B=0)
multiplication_10 = Multiplication(A=pow_4, B=courtyard_permeability)
multiplication_11 = Multiplication(A=pow_5, B=courtyard_permeability_2)
gradient_5 = Gradient(LowerLimit=0, UpperLimit=1, Parameter=multiplication_10, stops=[0.15: RGB(211, 211, 211), 0.855: RGB(0, 100, 0)])
gradient_6 = Gradient(LowerLimit=0, UpperLimit=1, Parameter=multiplication_11, stops=[0.15: RGB(211, 211, 211), 0.855: RGB(0, 100, 0)])

area_10 = Area(Geometry=boundary_33)  # -> Area, Centroid
area_11 = Area(Geometry=boundary_34)  # -> Area, Centroid
extr_14 = Extrude(Base=polyoffset_4.Holes, Direction=Z_5)
extr_15 = Extrude(Base=polyoffset_3.Holes, Direction=Z_6)
cap_8 = CapHoles(Brep=extr_14)
cap_9 = CapHoles(Brep=extr_15)

previewmat_11 = CustomPreviewMaterials(Geometry=cap_9, DiffuseColor=gradient_5)
previewmat_12 = CustomPreviewMaterials(Geometry=cap_8, DiffuseColor=gradient_6)

# ----
# Topography Projection / Translation
number_slider_32 = Slider(52, range=0..100)  # disabled
number_slider_33 = Slider(62, range=0..100)  # disabled
crv_14 = Curve(<curve referenced from the Rhino model>)  # disabled
patch = Patch(Curves=crv_14, Points=pt_6, Spans=number_slider_33, Flexibility=number_slider_32, Trim=True)  # disabled
crv_15 = Curve(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)  # disabled
end_2 = EndPoints(Curve=crv_15)  # -> Start, End; disabled
move_7 = Move(Motion=Vector(0, 0, 10))  # -> Geometry, Transform; disabled
vec2pt = Vector2Pt(PointA=end_2.Start, PointB=end_2.End, Unitize=False)  # -> Vector, Length; disabled
project_6 = Project(Direction=Vector(0, 0, 1))  # disabled
move_8 = Move(Geometry=del, Motion=vec2pt.Vector)  # -> Geometry, Transform; disabled
amoments = AreaMoments(Geometry=geometry)  # -> Area, Centroid, Inertia, InertiaError, Secondary, SecondaryError, Gyration
pt_13 = Point(Point(-6938.610562, 460.7623914, 0))
xy_5 = XYPlane(Origin=pt_13)
project_7 = Project(Geometry=amoments.Centroid, Plane=xy_5)  # -> Geometry, Transform
Z_22 = UnitZ(Factor=1)
pipeline_11 = GeometryPipeline(
    GroupByLayer=False,
    GroupByType=False,
    IncludeHidden=True,
    IncludeLocked=True,
    LayerFilter="*Context::Building Footprints::Mass",
    NameFilter="*",
    SublayerFiltering=True,
    TypeFilter=1073741848)
line_4 = LineSDL(Start=project_7.Geometry, Direction=Z_22, Length=Slider(3000, range=0..10000))
bcx = BrepCurve(Brep=surface, Curve=graft(line_4))  # -> Curves, Points
vec2pt_2 = Vector2Pt(PointA=flatten(project_7.Geometry), PointB=flatten(bcx.Points), Unitize=False)  # -> graft(Vector), Length
geometry_2 = Geometry(pipeline_11)
debrep = DeconstructBrep(Brep=geometry_2)  # -> Faces, Edges, Vertices
area_12 = Area(Geometry=debrep.Faces)  # -> Area, Centroid
pdecon_4 = Deconstruct(Point=area_12.Centroid)  # -> XComponent, YComponent, ZComponent
equals_8 = Equality(FirstNumber=pdecon_4.ZComponent, SecondNumber=0)  # -> Equality, Inequality
move_9 = Move(Geometry=graft_13, Motion=vec2pt_2.Vector)  # -> Geometry, Transform
edges_6 = BrepEdges(Brep=sdiff_7)  # -> Naked, Interior, NonManifold
move_10 = Move(Geometry=geometry, Motion=vec2pt_2.Vector)  # -> Geometry, Transform
edges_7 = BrepEdges(Brep=sdiff_3)  # -> Naked, Interior, NonManifold
edges_8 = BrepEdges(Brep=boundary_21)  # -> Naked, Interior, NonManifold
edges_9 = BrepEdges(Brep=sdiff_5)  # -> Naked, Interior, NonManifold
cull_21 = CullPattern(List=debrep.Faces, CullPattern=equals_8.Equality)
edges_10 = BrepEdges(Brep=move_9.Geometry)  # -> Naked, Interior, NonManifold
project_8 = Project(Curve=edges_6.Naked, Brep=surface, Direction=Vector(0, 0, 1))
project_9 = Project(Curve=edges_7.Naked, Brep=surface, Direction=Vector(0, 0, 1))
project_10 = Project(Curve=edges_8.Naked, Brep=surface, Direction=Vector(0, 0, 1))  # -> flatten(Curve)
project_11 = Project(Curve=edges_9.Naked, Brep=surface, Direction=Vector(0, 0, 1))
Z_23 = UnitZ(Factor="0.2")
pipeline_12 = GeometryPipeline(
    GroupByLayer=False,
    GroupByType=False,
    IncludeHidden=True,
    IncludeLocked=True,
    LayerFilter="*Context::Car Network",
    NameFilter="*",
    SublayerFiltering=True,
    TypeFilter=4)
project_12 = Project(Curve=cull_21, Brep=surface, Direction=Vector(0, 0, 1))
srfsplit = SurfaceSplit(Surface=surface, Curves=project_10)
geo_19 = Geometry([geo_10, simplify.Curve])
x_tremez = Extremes(Curve=project_12, Plane=PlaneXY(0, 0, 0))  # -> Highest, Lowest
move_11 = Move(Geometry=project_8, Motion=Z_23)  # -> Geometry, Transform
project_13 = Project(Curve=flatten(geo_19), Brep=surface, Direction=Vector(0, 0, 1))
merge_12 = Merge(Data1=project_8, Data2=move_11.Geometry)  # -> simplify(Result)
pt_14 = Point(x_tremez.Lowest)
cull_i = CullIndex(List=srfsplit, Indices=Slider(0, range=0..100), Wrap=True)
project_14 = Project(Curve=pipeline_12, Brep=surface, Direction=Vector(0, 0, 1))
pdecon_5 = Deconstruct(Point=pt_14)  # -> XComponent, YComponent, ZComponent
srfsplit_2 = SurfaceSplit(Surface=surface, Curves=project_13)
pt_15 = ConstructPoint(XCoordinate=pdecon_5.XComponent, YCoordinate=pdecon_5.YComponent, ZCoordinate="0")
cull_22 = CullPattern(List=srfsplit_2, CullPattern=[False, True])
vec2pt_3 = Vector2Pt(PointA=pt_15, PointB=pt_14, Unitize=False)  # -> flatten(Vector), Length
move_12 = Move(Geometry=geometry_2, Motion=vec2pt_3.Vector)  # -> Geometry, Transform
edges_11 = BrepEdges(Brep=move_12.Geometry)  # -> Naked, Interior, NonManifold
Z_24 = UnitZ(Factor=0.5)
move_13 = Move(Geometry=cull_22, Motion=Z_24)  # -> Geometry, Transform
previewmat_13 = CustomPreviewMaterials(Geometry=move_9.Geometry, DiffuseColor=RGB(197, 217, 147))
previewmat_14 = CustomPreviewMaterials(Geometry=move_10.Geometry, DiffuseColor=RGB(197, 217, 147))
contour = Contour(Shape=surface, Point=Point(0, 0, 0), Direction=Vector(0, 0, 1), Distance=Slider(3, range=0..10))
previewmat_15 = CustomPreviewMaterials(Geometry=move_13.Geometry, DiffuseColor=RGB(171, 199, 119))
Z_25 = UnitZ(Factor=0.5)
previewlw_14 = CustomPreviewLineweights(Geometry=project_14, Shader=ColourSwatch(SwatchColor=RGB(0, 0, 0)), Thickness=1.7, Absolute=False)
previewmat_16 = CustomPreviewMaterials(Geometry=move_12.Geometry, DiffuseColor=RGB(255, 255, 255))
previewlw_15 = CustomPreviewLineweights(Geometry=edges_11.Interior, Shader=ColourSwatch(SwatchColor=RGB(64, 64, 64)), Absolute=False)
move_14 = Move(Geometry=contour, Motion=Z_25)  # -> Geometry, Transform
previewlw_16 = CustomPreviewLineweights(
    Geometry=move_14.Geometry,
    Shader={diffuse=RGB(225, 225, 227), emission=RGB(68, 68, 68), shine=0, specular=RGB(255, 255, 255), transparency=0},
    Absolute=False)
previewlw_17 = CustomPreviewLineweights(Geometry=edges_10.Interior, Shader=ColourSwatch(SwatchColor=RGB(64, 64, 64)), Absolute=False)

# ----
# Image to surface mapping
resolution = Panel("300")  # disabled
input_surface = Srf(patch)  # disabled
range = Range(Domain=Domain(0, 1), Steps=resolution)  # disabled
mesh_uv = MeshSurface(Surface=input_surface, UCount=resolution, VCount=resolution, Overhang=True, Equalize=False)  # disabled
mcol = MeshColours(
    Mesh=mesh_uv,
    Colours=[RGB(127, 255, 0), RGB(0, 100, 0), RGB(34, 139, 34), RGB(124, 252, 0), RGB(154, 205, 50), RGB(173, 255, 47), RGB(50, 205, 50), RGB(152, 251, 152)])  # disabled

# ----
# cross reference data matching
pt_16 = PointXYZ(XComponent=range, YComponent=range, ZComponent=0, DataComparison="cross_reference")  # disabled

# ----
# Mesh to Surface
mesh = Mesh(move_8.Geometry)  # disabled
demesh = DeconstructMesh(Mesh=mesh)  # -> Vertices, Faces, Colours, Normals; disabled
project_15 = Project(Geometry=demesh.Vertices, Plane=PlaneXY(0, 0, 0))  # -> Geometry, Transform; disabled
hull = ConvexHull(Points=project_15.Geometry, Plane=PlaneXY(0, 0, 0))  # -> Hull, HullZ, Indices; disabled
panel_11 = Panel(".1")  # disabled
discontinuity = Discontinuity(Curve=hull.Hull, Level=1)  # -> Points, Parameters; disabled
Y = UnitY(Factor=1)  # disabled
X = UnitX(Factor=1)  # disabled
conmesh = ConstructMesh(Vertices=project_15.Geometry, Faces=demesh.Faces)  # disabled
edgesdir = EdgesFromDirections(Brep=hull.Hull, Directions=[X, Y], Reflex=invert(True), Angle=panel_11)  # -> Edges, Indices, Map; disabled
crv_cp = CurveClosestPoint(Point=discontinuity.Points, Curve=hull.Hull)  # -> Point, Parameter, Distance; disabled
shatter_2 = Shatter(Curve=hull.Hull, Parameters=crv_cp.Parameter)  # disabled
item_13 = ListItem(List=shatter_2, Index=edgesdir.Indices, Wrap=True)  # -> graft(Item); disabled
panel_12 = Panel("0.001")  # disabled
crv_cp_2 = CurveClosestPoint(Point=project_15.Geometry, Curve=item_13)  # -> Point, Parameter, Distance; disabled
smaller_5 = SmallerThan(FirstNumber=crv_cp_2.Distance, SecondNumber=panel_12)  # -> SmallerThan, OrEqualTo; disabled
dispatch_9 = Dispatch(List=project_15.Geometry, DispatchPattern=smaller_5.SmallerThan)  # -> ListA, ListB; disabled
lng_7 = ListLength(List=dispatch_9.ListA)  # disabled
pshift_5 = ShiftPaths(Data=lng_7, Offset=-1)  # -> graft(Data); disabled
bang = ExplodeTree(Data=pshift_5)  # -> Branch0, Branch1; disabled
sdivide = DivideSurface(Surface=hull.Hull, UCount=bang.Branch0, VCount=bang.Branch1)  # -> Points, Normals, Parameters; disabled
pshift_6 = ShiftPaths(Data=sdivide.Points, Offset=-1)  # disabled
meshmap = MeshMap(SourceMesh=conmesh, TargetMesh=mesh, Point=pshift_6, Distance=1)  # disabled
srfgrid = SurfaceFromPoints(Points=meshmap, UCount=expr("x+1", bang.Branch0), Interpolate=False)  # -> flatten(Surface); disabled

# ----
# Building Height Attractor
# Connects to Boundary Surfaces in 'Buildings'
# Connects to ftpt (Building Footprints) from Buildings Component in 'Buildings'
pipeline_13 = GeometryPipeline(
    GroupByLayer=False,
    GroupByType=False,
    IncludeHidden=True,
    IncludeLocked=True,
    LayerFilter="*KeyPoints",
    NameFilter="*",
    SublayerFiltering=True,
    TypeFilter=1)
cull_23 = CullPattern(List=buildings.BuildingFootprint, CullPattern=larger_2.LargerThan)
pcen_3 = PolygonCenter(Polyline=cull_23)  # -> CenterV, CenterE, simplify(flatten(CenterA))
pt_17 = Point(graft(pcen_3.CenterA))
dist_3 = Distance(PointA=pt_17, PointB=pipeline_13)
avr_9 = Average(Input=dist_3)
larger_5 = LargerThan(FirstNumber=dist_3, SecondNumber=avr_9)  # -> LargerThan, OrEqualTo
dispatch_10 = Dispatch(List=dist_3, DispatchPattern=larger_5.LargerThan)  # -> ListA, ListB
flatten_15 = FlattenTree(Tree=dispatch_10.ListA, Path="{0}")
bnd_7 = Bounds(Numbers=flatten_15)
dom_12 = ConstructDomain(DomainStart=Slider(1, range=0..1), DomainEnd=Slider(0, range=0..100))
remap_6 = RemapNumbers(Value=flatten_15, Source=bnd_7, Target=dom_12)  # -> Mapped, Clipped
eº_2 = PowerOfE(Value=remap_6.Mapped)
bnd_8 = Bounds(Numbers=eº_2)
dom_13 = ConstructDomain(DomainStart=Slider(10, range=0..10), DomainEnd=Slider(13, range=0..100))
remap_7 = RemapNumbers(Value=eº_2, Source=bnd_8, Target=dom_13)  # -> flatten(Mapped), Clipped
culln_2 = CullNth(List=boundary_31, CullFrequency=2)
flatten_16 = FlattenTree(Tree=culln_2, Path="{0}")
graft_20 = GraftTree(Tree=flatten_16, IncludeEmptyLists=True, IncludeNullItems=True)

crv_cp_3 = CurveClosestPoint(Point=simplify(graft(pt_17)), Curve=pipeline_7)  # -> Point, Parameter, Distance
subtraction_6 = Subtraction(A=remap_7.Mapped, B=3)
addition_5 = Addition(A=remap_7.Mapped, B=3)
dom_14 = ConstructDomain(DomainStart=subtraction_6, DomainEnd=addition_5)  # -> graft(Domain)
index_6 = ItemIndex(List=flatten(dom_14), Item=flatten(dom_14))  # -> graft(Index)
smaller_6 = SmallerThan(FirstNumber=crv_cp_3.Distance, SecondNumber=Slider(45, range=0..100))  # -> SmallerThan, OrEqualTo
random_4 = Random(Range=dom_14, Number=1, Seed=index_6)

roundn_3 = RoundToNearest(NumbersX=random_4, NumbersY=[4, 7, 10, 13, 16, 19, 22, 25, 28, 31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], RemapX=False)  # -> flatten(Nearest), Index, Difference, RemappedX
graft_21 = GraftTree(Tree=roundn_3.Nearest, IncludeEmptyLists=True, IncludeNullItems=True)
Z_26 = UnitZ(Factor=graft_21)
extr_16 = Extrude(Base=graft_20, Direction=Z_26)
cap_10 = CapHoles(Brep=extr_16)  # -> simplify(Brep)
preview_3d_buildings_2 = CustomPreview(Geometry=cap_10, Shader=ColourSwatch(SwatchColor=RGB(225, 225, 227)))

edges_12 = BrepEdges(Brep=cap_10)  # -> Naked, Interior, NonManifold
cull_24 = CullPattern(List=pt_17, CullPattern=smaller_6.OrEqualTo)
move_15 = Move(Geometry=cull_24, Motion=Z_7)  # -> flatten(Geometry), Transform
previewlw_18 = CustomPreviewLineweights(
    Geometry=edges_12.Interior,
    Shader=ColourSwatch(SwatchColor=RGB(14, 24, 51)),
    Thickness=Slider(2.9, range=0..10),
    Absolute=False)
brepinc = PointInBrep(Brep=cap_10, Point=move_15.Geometry, Strict=False)

# ----
# Rooftop Segmentation
geo_20 = Geometry(flatten([cap_7, cap_10]))
debrep_2 = DeconstructBrep(Brep=geo_20)  # -> Faces, Edges, Vertices
area_13 = Area(Geometry=debrep_2.Faces)  # -> Area, Centroid
pdecon_6 = Deconstruct(Point=area_13.Centroid)  # -> XComponent, YComponent, ZComponent
bnd_9 = Bounds(Numbers=pdecon_6.ZComponent)
dedomain_4 = DeconstructDomain(Domain=bnd_9)  # -> Start, End
equals_9 = Equality(FirstNumber=pdecon_6.ZComponent, SecondNumber=dedomain_4.End)  # -> Equality, Inequality
cull_25 = CullPattern(List=debrep_2.Faces, CullPattern=equals_9.Equality)  # -> simplify(List)
brec_2 = BoundingRectangle(Geometry=cull_25, Plane=PlaneXY(0, 0, 0), Axis=0, Slide=0, Union=True)  # -> Bounding, DimensionX, DimensionY
number_slider_34 = Slider(3, range=0..10)
division_7 = Division(A=brec_2.DimensionY, B=number_slider_34)
division_8 = Division(A=brec_2.DimensionX, B=number_slider_34)
grid = GridStructure(Surface=brec_2.Bounding, UDivisions=division_8, VDivisions=division_7)  # -> simplify(StructureLines), StructureNodes
srfsplit_3 = SurfaceSplit(Surface=cull_25, Curves=grid.StructureLines)
area_14 = Area(Geometry=srfsplit_3)  # -> Area, Centroid
pdecon_7 = Deconstruct(Point=area_14.Centroid)  # -> XComponent, YComponent, ZComponent
bnd_10 = Bounds(Numbers=pdecon_7.YComponent)
solar_roof = Slider(0.25, range=0..1)
dedomain_5 = DeconstructDomain(Domain=bnd_10)  # -> Start, End
subtraction_7 = Subtraction(A=dedomain_5.End, B=dedomain_5.Start)
subtraction_8 = Subtraction(A=1, B=solar_roof)
multiplication_12 = Multiplication(A=subtraction_7, B=subtraction_8)
addition_6 = Addition(A=dedomain_5.Start, B=multiplication_12)
smaller_7 = SmallerThan(FirstNumber=pdecon_7.YComponent, SecondNumber=addition_6)  # -> SmallerThan, OrEqualTo
sqr_2 = Square(Value=number_slider_34)
dispatch_11 = Dispatch(List=srfsplit_3, DispatchPattern=smaller_7.SmallerThan)  # -> ListA, ListB
solar_panel_space = Geometry(dispatch_11.ListB)
green_roofs = Geometry(dispatch_11.ListA)

# ---- group: Building
geometry_3 = Geometry(geo_20)

# ----
addition_7 = Addition(A=roundn_3.Index, B=1)  # disabled
no_floors_2 = Panel(addition_7)  # disabled

# ----
# Solar Panels
number_slider_35 = Slider(3, range=0..10)
number_slider_36 = Slider(0.1, range=0..0.1)
number_slider_37 = Slider(0, range=0..100)
division_9 = Division(A=number_slider_35, B=2)
pt_18 = ConstructPoint(XCoordinate=number_slider_37, YCoordinate=number_slider_35, ZCoordinate=number_slider_37)
pt_19 = ConstructPoint(XCoordinate=division_9, YCoordinate=division_9, ZCoordinate=number_slider_37)
pt_20 = ConstructPoint(XCoordinate=number_slider_37, YCoordinate=number_slider_37, ZCoordinate=number_slider_37)
rectangle = Rectangle(Plane=PlaneXY(0, 0, 0), XSize=Domain(0.5, 3), YSize=Domain(0.1, 3), Radius=0)  # -> Rectangle, Length
neg_4 = Negative(Value=number_slider_36)
panel_angle = Slider(37, range=0..90)
edges_13 = BrepEdges(Brep=solar_panel_space)  # -> Naked, Interior, NonManifold
graft_22 = GraftTree(Tree=solar_panel_space, IncludeEmptyLists=True, IncludeNullItems=True)
ln_10 = Line(StartPoint=pt_20, EndPoint=pt_18)
X_2 = UnitX(Factor=number_slider_35)
offset_7 = OffsetCurve(Curve=rectangle.Rectangle, Distance=neg_4)
len_6 = Length(Curve=edges_13.Naked)
move_16 = Move(Geometry=ln_10, Motion=X_2)  # -> Geometry, Transform
boundary_35 = BoundarySurfaces(Edges=[rectangle.Rectangle, offset_7])
Z_27 = UnitZ(Factor=number_slider_36)
bnd_11 = Bounds(Numbers=len_6)
extr_17 = Extrude(Base=boundary_35, Direction=Z_27)
dedomain_6 = DeconstructDomain(Domain=bnd_11)  # -> Start, End
boundary_36 = BoundarySurfaces(Edges=offset_7)
cap_11 = CapHoles(Brep=extr_17)
subtraction_9 = Subtraction(A=90, B=panel_angle)
division_10 = Division(A=dedomain_6.End, B=dedomain_6.Start)
X_3 = UnitX(Factor=1)
Y_2 = UnitY(Factor=1)
neg_5 = Negative(Value=subtraction_9)
smaller_8 = SmallerThan(FirstNumber=division_10, SecondNumber=Slider(1.1, range=1..2))  # -> SmallerThan, OrEqualTo
vrot = Rotate(Vector=X_3, Axis=Y_2, Angle=degrees(neg_5))
cull_26 = CullPattern(List=graft_22, CullPattern=smaller_8.OrEqualTo)
rotax = RotateAxis(Geometry=[cap_11, boundary_36], Angle=degrees(panel_angle), Axis=move_16.Geometry)  # -> Geometry, Transform
line_5 = LineSDL(Start=pt_19, Direction=vrot, Length=0.2)
area_15 = Area(Geometry=cull_26)  # -> Area, Centroid
ext_to_geo = ExtendToGeometry(Curve=line_5, Geometry=rotax.Geometry, Side=1, Style=1)
pipe = Pipe(Curve=ext_to_geo, Radius=0.1, Caps=0)
group_2 = Group(Objects=flatten([pipe, rotax.Geometry]))
xy_6 = XYPlane(Origin=pt_19)
rotate_2 = Rotate(Geometry=group_2, Angle=degrees(270), Plane=xy_6)  # -> Geometry, Transform
move2pt = MoveToPoint(Geometry=rotate_2.Geometry, PointA=pt_19, PointB=area_15.Centroid)  # -> Moved, Vector, Transform
previewmat_17 = CustomPreviewMaterials(Geometry=move2pt.Moved, DiffuseColor=RGB(97, 103, 135))

# ----
# Green Roofs
join_8 = BrepJoin(Breps=green_roofs)  # -> Breps, Closed
edges_14 = BrepEdges(Brep=join_8.Breps)  # -> Naked, Interior, NonManifold
number_slider_38 = Slider(0.4, range=0..1)
join_9 = JoinCurves(Curves=edges_14.Naked, Preserve=False)
offset_8 = OffsetCurve(Curve=join_9, Distance=number_slider_38)
boundary_37 = BoundarySurfaces(Edges=offset_8)
boundary_38 = BoundarySurfaces(Edges=[join_9, offset_8])
Z_28 = UnitZ(Factor=Slider(0.1, range=0..0.1))
Z_29 = UnitZ(Factor=number_slider_38)
extr_18 = Extrude(Base=boundary_37, Direction=Z_28)
cap_12 = CapHoles(Brep=extr_18)
extr_19 = Extrude(Base=boundary_38, Direction=Z_29)
cap_13 = CapHoles(Brep=extr_19)
previewmat_18 = CustomPreviewMaterials(Geometry=cap_13, DiffuseColor=RGB(255, 255, 255))
previewmat_19 = CustomPreviewMaterials(Geometry=cap_12, DiffuseColor=ColourSwatch(SwatchColor=RGB(59, 112, 47)))

panel_13 = Panel(cap_12)
clean_7 = CleanTree(RemoveNulls=True, RemoveInvalid=True, RemoveEmpty=True, Tree=area_15.Centroid)  # -> flatten(Tree)
lng_8 = ListLength(List=clean_7)
simplify_3 = SimplifyTree(Tree=move2pt.Moved, Front=False)
trim_2 = TrimTree(Tree=simplify_3, Depth=1)
area_16 = Area(Geometry=boundary_36)  # -> Area, Centroid
area_17 = Area(Geometry=boundary_36)  # -> Area, Centroid
group_3 = Group(Objects=trim_2)

debrep_3 = DeconstructBrep(Brep=geometry_3)  # -> Faces, Edges, Vertices
area_18 = Area(Geometry=debrep_3.Faces)  # -> Area, Centroid
pdecon_8 = Deconstruct(Point=area_18.Centroid)  # -> XComponent, YComponent, ZComponent
equals_10 = Equality(FirstNumber=pdecon_8.ZComponent, SecondNumber=0)  # -> Equality, Inequality
cull_27 = CullPattern(List=debrep_3.Faces, CullPattern=equals_10.Equality)
project_16 = Project(Curve=cull_27, Brep=surface, Direction=Vector(0, 0, 1))
x_tremez_2 = Extremes(Curve=project_16, Plane=PlaneXY(0, 0, 0))  # -> Highest, Lowest
pt_21 = Point(x_tremez_2.Lowest)
pdecon_9 = Deconstruct(Point=pt_21)  # -> XComponent, YComponent, ZComponent
pt_22 = ConstructPoint(XCoordinate=pdecon_9.XComponent, YCoordinate=pdecon_9.YComponent, ZCoordinate="0")
vec2pt_4 = Vector2Pt(PointA=pt_22, PointB=pt_21, Unitize=False)  # -> flatten(Vector), Length
graft_23 = GraftTree(Tree=vec2pt_4.Vector, IncludeEmptyLists=True, IncludeNullItems=True)  # -> simplify(Tree)
move_17 = Move(Geometry=cap_12, Motion=graft(vec2pt_4.Vector))  # -> Geometry, Transform
move_18 = Move(Geometry=cap_12, Motion=graft(vec2pt_4.Vector))  # -> Geometry, Transform
move_19 = Move(Geometry=cap_13, Motion=graft(vec2pt_4.Vector))  # -> Geometry, Transform
move_20 = Move(Geometry=geometry_3, Motion=vec2pt_4.Vector)  # -> Geometry, Transform
move_21 = Move(Geometry=group_3, Motion=graft_23)  # -> Geometry, Transform
edges_15 = BrepEdges(Brep=move_20.Geometry)  # -> Naked, Interior, NonManifold
previewmat_20 = CustomPreviewMaterials(Geometry=move_21.Geometry, DiffuseColor=RGB(31, 24, 71))
previewmat_21 = CustomPreviewMaterials(Geometry=move_19.Geometry, DiffuseColor=RGB(255, 255, 255))
previewmat_22 = CustomPreviewMaterials(Geometry=move_20.Geometry, DiffuseColor=RGB(255, 255, 255))
previewlw_19 = CustomPreviewLineweights(Geometry=edges_15.Interior, Shader=ColourSwatch(SwatchColor=RGB(64, 64, 64)), Absolute=False)
previewmat_23 = CustomPreviewMaterials(Geometry=move_17.Geometry, DiffuseColor=RGB(38, 105, 7))

multiplication_13 = Multiplication(A=area_16.Area, B=lng_8)
multiplication_14 = Multiplication(A=multiplication_13, B=kw_m_2)
total_solar_panel_area_m_2 = Panel(multiplication_13)

# ----
# Scenario Statistics
pipeline_14 = GeometryPipeline(
    GroupByLayer=False,
    GroupByType=False,
    IncludeHidden=True,
    IncludeLocked=True,
    LayerFilter="*BakedGeometry::Buildings::Institutional",
    NameFilter="*",
    SublayerFiltering=True,
    TypeFilter=1073741848)
pipeline_15 = GeometryPipeline(
    GroupByLayer=False,
    GroupByType=False,
    IncludeHidden=True,
    IncludeLocked=True,
    LayerFilter="*BakedGeometry::Buildings::Commercial",
    NameFilter="*",
    SublayerFiltering=True,
    TypeFilter=1073741848)
pipeline_16 = GeometryPipeline(
    GroupByLayer=False,
    GroupByType=False,
    IncludeHidden=True,
    IncludeLocked=True,
    LayerFilter="*BakedGeometry::Buildings::Residential",
    NameFilter="*",
    SublayerFiltering=True,
    TypeFilter=1073741848)
pipeline_17 = GeometryPipeline(
    GroupByLayer=False,
    GroupByType=False,
    IncludeHidden=True,
    IncludeLocked=True,
    LayerFilter="*BakedGeometry::Trees::Street Canopies",
    NameFilter="*",
    SublayerFiltering=True,
    TypeFilter=1073741848)
pipeline_18 = GeometryPipeline(
    GroupByLayer=False,
    GroupByType=False,
    IncludeHidden=True,
    IncludeLocked=True,
    LayerFilter="*BakedGeometry::Buildings::Office",
    NameFilter="*",
    SublayerFiltering=True,
    TypeFilter=1073741848)
pipeline_19 = GeometryPipeline(
    GroupByLayer=False,
    GroupByType=False,
    IncludeHidden=True,
    IncludeLocked=True,
    LayerFilter="*BakedGeometry::Buildings::Mixed",
    NameFilter="*",
    SublayerFiltering=True,
    TypeFilter=1073741848)
pipeline_20 = GeometryPipeline(
    GroupByLayer=False,
    GroupByType=False,
    IncludeHidden=True,
    IncludeLocked=True,
    LayerFilter="*BakedGeometry::Trees::Canopies",
    NameFilter="*",
    SublayerFiltering=True,
    TypeFilter=1073741848)
pipeline_21 = GeometryPipeline(
    GroupByLayer=False,
    GroupByType=False,
    IncludeHidden=True,
    IncludeLocked=True,
    LayerFilter="*Context::Trees::Points",
    NameFilter="*",
    SublayerFiltering=True,
    TypeFilter=1073741849)
debrep_4 = DeconstructBrep(Brep=pipeline_19)  # -> Faces, Edges, Vertices
debrep_5 = DeconstructBrep(Brep=pipeline_16)  # -> Faces, Edges, Vertices
debrep_6 = DeconstructBrep(Brep=pipeline_18)  # -> Faces, Edges, Vertices
debrep_7 = DeconstructBrep(Brep=pipeline_15)  # -> Faces, Edges, Vertices
debrep_8 = DeconstructBrep(Brep=pipeline_14)  # -> Faces, Edges, Vertices
area_19 = Area(Geometry=debrep_4.Faces)  # -> Area, Centroid
area_20 = Area(Geometry=debrep_4.Faces)  # -> Area, Centroid
area_21 = Area(Geometry=debrep_5.Faces)  # -> Area, Centroid
area_22 = Area(Geometry=debrep_5.Faces)  # -> Area, Centroid
area_23 = Area(Geometry=debrep_6.Faces)  # -> Area, Centroid
area_24 = Area(Geometry=debrep_7.Faces)  # -> Area, Centroid
area_25 = Area(Geometry=debrep_6.Faces)  # -> Area, Centroid
area_26 = Area(Geometry=debrep_7.Faces)  # -> Area, Centroid
area_27 = Area(Geometry=debrep_8.Faces)  # -> Area, Centroid
area_28 = Area(Geometry=debrep_8.Faces)  # -> Area, Centroid
street_trees = ListLength(List=flatten(pipeline_17))
park_trees = ListLength(List=flatten(pipeline_20))
existing_trees = ListLength(List=flatten(pipeline_21))
pdecon_10 = Deconstruct(Point=area_19.Centroid)  # -> XComponent, YComponent, ZComponent
pdecon_11 = Deconstruct(Point=area_21.Centroid)  # -> XComponent, YComponent, ZComponent
pdecon_12 = Deconstruct(Point=area_23.Centroid)  # -> XComponent, YComponent, ZComponent
pdecon_13 = Deconstruct(Point=area_24.Centroid)  # -> XComponent, YComponent, ZComponent
pdecon_14 = Deconstruct(Point=area_27.Centroid)  # -> XComponent, YComponent, ZComponent
equals_11 = Equality(FirstNumber=pdecon_10.ZComponent, SecondNumber=0)  # -> Equality, Inequality
equals_12 = Equality(FirstNumber=pdecon_11.ZComponent, SecondNumber=0)  # -> Equality, Inequality
equals_13 = Equality(FirstNumber=pdecon_12.ZComponent, SecondNumber=0)  # -> Equality, Inequality
equals_14 = Equality(FirstNumber=pdecon_13.ZComponent, SecondNumber=0)  # -> Equality, Inequality
equals_15 = Equality(FirstNumber=pdecon_14.ZComponent, SecondNumber=0)  # -> Equality, Inequality
ma_3 = MassAddition(Input=[existing_trees, street_trees, park_trees])  # -> Result, PartialResults
addition_8 = Addition(A=street_trees, B=park_trees)
bnd_12 = Bounds(Numbers=pdecon_10.ZComponent)
bnd_13 = Bounds(Numbers=pdecon_11.ZComponent)
bnd_14 = Bounds(Numbers=pdecon_12.ZComponent)
bnd_15 = Bounds(Numbers=pdecon_13.ZComponent)
bnd_16 = Bounds(Numbers=pdecon_14.ZComponent)
new_trees = Multiplication(A=addition_8, B=10)
old_trees = Multiplication(A=existing_trees, B=21)
dedomain_7 = DeconstructDomain(Domain=bnd_12)  # -> Start, simplify(End)
cull_28 = CullPattern(List=debrep_4.Faces, CullPattern=equals_11.Equality)
dedomain_8 = DeconstructDomain(Domain=bnd_13)  # -> Start, simplify(End)
cull_29 = CullPattern(List=debrep_5.Faces, CullPattern=equals_12.Equality)
dedomain_9 = DeconstructDomain(Domain=bnd_14)  # -> Start, simplify(End)
dedomain_10 = DeconstructDomain(Domain=bnd_15)  # -> Start, simplify(End)
cull_30 = CullPattern(List=debrep_6.Faces, CullPattern=equals_13.Equality)
cull_31 = CullPattern(List=debrep_7.Faces, CullPattern=equals_14.Equality)
dedomain_11 = DeconstructDomain(Domain=bnd_16)  # -> Start, simplify(End)
cull_32 = CullPattern(List=debrep_8.Faces, CullPattern=equals_15.Equality)
addition_9 = Addition(A=old_trees, B=new_trees)
edges_16 = BrepEdges(Brep=cull_28)  # -> Naked, Interior, NonManifold
building_storeys = Division(A=dedomain_7.End, B=4)
flatten_17 = FlattenTree(Tree=dedomain_7.End, Path="{0}")
flatten_18 = FlattenTree(Tree=dedomain_10.End, Path="{0}")
edges_17 = BrepEdges(Brep=cull_29)  # -> Naked, Interior, NonManifold
building_storeys_2 = Division(A=dedomain_8.End, B=4)
flatten_19 = FlattenTree(Tree=dedomain_8.End, Path="{0}")
edges_18 = BrepEdges(Brep=cull_30)  # -> Naked, Interior, NonManifold
edges_19 = BrepEdges(Brep=cull_31)  # -> Naked, Interior, NonManifold
building_storeys_3 = Division(A=dedomain_9.End, B=4)
building_storeys_4 = Division(A=dedomain_10.End, B=4)
flatten_20 = FlattenTree(Tree=dedomain_9.End, Path="{0}")
edges_20 = BrepEdges(Brep=cull_32)  # -> Naked, Interior, NonManifold
building_storeys_5 = Division(A=dedomain_11.End, B=4)
flatten_21 = FlattenTree(Tree=dedomain_11.End, Path="{0}")
join_10 = JoinCurves(Curves=edges_16.Naked, Preserve=False)
join_11 = JoinCurves(Curves=edges_17.Naked, Preserve=False)
join_12 = JoinCurves(Curves=edges_18.Naked, Preserve=False)
join_13 = JoinCurves(Curves=edges_19.Naked, Preserve=False)
green_space_area = Area(Geometry=flatten(boundary_13))  # -> Area, Centroid
green_space_area_2 = Area(Geometry=flatten(boundary_13))  # -> Area, Centroid
join_14 = JoinCurves(Curves=edges_20.Naked, Preserve=False)
area_29 = Area(Geometry=join_10)  # -> simplify(Area), Centroid
area_30 = Area(Geometry=join_10)  # -> simplify(Area), Centroid
area_31 = Area(Geometry=join_11)  # -> simplify(Area), Centroid
area_32 = Area(Geometry=join_11)  # -> simplify(Area), Centroid
subtraction_10 = Subtraction(A=building_storeys, B=1)
area_33 = Area(Geometry=join_13)  # -> simplify(Area), Centroid
area_34 = Area(Geometry=join_12)  # -> simplify(Area), Centroid
area_35 = Area(Geometry=join_12)  # -> simplify(Area), Centroid
area_36 = Area(Geometry=join_13)  # -> simplify(Area), Centroid
area_37 = Area(Geometry=join_14)  # -> simplify(Area), Centroid
area_38 = Area(Geometry=join_14)  # -> simplify(Area), Centroid
ma_4 = MassAddition(Input=green_space_area.Area)  # -> Result, PartialResults
area_39 = Area(Geometry=flatten([boundary_32, cull_20]))  # -> Area, Centroid
area_40 = Area(Geometry=flatten([cull_20, cull_23]))  # -> Area, Centroid
area_41 = Area(Geometry=pipeline_3)  # -> Area, Centroid
area_42 = Area(Geometry=pipeline_3)  # -> Area, Centroid
area_43 = Area()  # -> Area, Centroid
area_44 = Area(Geometry=[polyoffset_3.Holes, polyoffset_4.Holes])  # -> Area, Centroid
multiplication_15 = Multiplication(A=area_31.Area, B=building_storeys_2)
multiplication_16 = Multiplication(A=area_30.Area, B=subtraction_10)
multiplication_17 = Multiplication(A=area_34.Area, B=building_storeys_3)
multiplication_18 = Multiplication(A=area_33.Area, B=building_storeys_4)
multiplication_19 = Multiplication(A=area_37.Area, B=building_storeys_5)
ma_5 = MassAddition(Input=flatten(area_30.Area))  # -> Result, PartialResults
ma_6 = MassAddition(Input=flatten(multiplication_15))  # -> Result, PartialResults
ma_7 = MassAddition(Input=flatten(multiplication_16))  # -> Result, PartialResults
ma_8 = MassAddition(Input=flatten(multiplication_17))  # -> Result, PartialResults
ma_9 = MassAddition(Input=flatten(multiplication_18))  # -> Result, PartialResults
ma_10 = MassAddition(Input=flatten(multiplication_19))  # -> Result, PartialResults
ma_11 = MassAddition(Input=flatten(area_44.Area))  # -> Result, PartialResults
ma_12 = MassAddition(Input=area_39.Area)  # -> Result, PartialResults
addition_10 = Addition(A=ma_6.Result, B=ma_7.Result)
subtraction_11 = Subtraction(A=area_41.Area, B=ma_4.Result)
subtraction_12 = Subtraction(A=ma_11.Result, B=ma_12.Result)
addition_11 = Addition(A=ma_5.Result, B=ma_9.Result)
ma_13 = MassAddition(Input=flatten([addition_10, addition_11, ma_10.Result, ma_8.Result]))  # -> Result, PartialResults
summer = Slider(7.16, range=0..10)
division_11 = Division(A=ma_4.Result, B=area_41.Area)
autumn = Slider(3.58, range=0..10)
spring = Slider(5.55, range=0..10)
winter = Slider(2.45, range=0..10)
roundd = RoundToDecimalPlace(NumberX=subtraction_12, DecimalPlace=1, RoundType=0)  # -> Rounded, Difference
roundd_2 = RoundToDecimalPlace(NumberX=ma_8.Result, DecimalPlace=1, RoundType=0)  # -> Rounded, Difference
roundd_3 = RoundToDecimalPlace(NumberX=ma_13.Result, DecimalPlace=1, RoundType=0)  # -> Rounded, Difference
roundd_4 = RoundToDecimalPlace(NumberX=ma_12.Result, DecimalPlace=1, RoundType=0)  # -> Rounded, Difference
building_efficiency_ratio = Multiplication(A=addition_10, B=0.85)
roundd_5 = RoundToDecimalPlace(NumberX=addition_11, DecimalPlace=1, RoundType=0)  # -> Rounded, Difference
multiplication_20 = Multiplication(A=division_11, B=100)
roundd_6 = RoundToDecimalPlace(NumberX=ma_10.Result, DecimalPlace=1, RoundType=0)  # -> Rounded, Difference
street_lengths = Length(Curve=flatten(pipeline))
permeability_factor = Multiplication(A=roundd.Rounded, B=Slider(0.25, range=0..1))
multiplication_21 = Multiplication(A=multiplication_14, B=summer)
green_space_area_ha = Division(A=ma_4.Result, B=10000)
average_home_size = Division(A=building_efficiency_ratio, B=99.1)
multiplication_22 = Multiplication(A=multiplication_14, B=spring)
multiplication_23 = Multiplication(A=multiplication_14, B=autumn)
multiplication_24 = Multiplication(A=multiplication_14, B=winter)
street_lengths_2 = Length(Curve=flatten(geo_7))
area_45 = Area(Geometry=sdiff_3)  # -> Area, Centroid
area_46 = Area(Geometry=sdiff_7)  # -> Area, Centroid
area_47 = Area(Geometry=sdiff_7)  # -> Area, Centroid
area_48 = Area(Geometry=sdiff_3)  # -> Area, Centroid
area_49 = Area(Geometry=boundary_21)  # -> Area, Centroid
area_50 = Area(Geometry=boundary_21)  # -> Area, Centroid
ma_14 = MassAddition(Input=street_lengths)  # -> Result, PartialResults
bnd_17 = Bounds(Numbers=flatten([flatten_21, flatten_19, flatten_17, flatten_18, flatten_20]))
avr_10 = Average(Input=flatten([flatten_21, flatten_19, flatten_17, flatten_18, flatten_20]))
lawn_sequestration = Multiplication(A=green_space_area_ha, B=1121)
division_12 = Division(A=ma_14.Result, B=1000)
ma_15 = MassAddition(Input=area_46.Area)  # -> Result, PartialResults
multiplication_25 = Multiplication(A=average_home_size, B=2.5)
ma_16 = MassAddition(Input=area_45.Area)  # -> Result, PartialResults
int = Integer(average_home_size)
ma_17 = MassAddition(Input=area_49.Area)  # -> Result, PartialResults
ma_18 = MassAddition(Input=[ma_15.Result, ma_16.Result, ma_17.Result])  # -> Result, PartialResults
ma_19 = MassAddition(Input=street_lengths_2)  # -> Result, PartialResults
kwh_summer = Multiplication(A=91.25, B=multiplication_21)
kwh_autumn = Multiplication(A=91.25, B=multiplication_23)
kwh_winter = Multiplication(A=91.25, B=multiplication_24)
kwh_spring = Multiplication(A=91.25, B=multiplication_22)
roundd_7 = RoundToDecimalPlace(NumberX=addition_10, DecimalPlace=1, RoundType=0)  # -> Rounded, Difference
ma_20 = MassAddition(Input=flatten([area_10.Area, area_11.Area]))  # -> Result, PartialResults
roundd_8 = RoundToDecimalPlace(NumberX=building_efficiency_ratio, DecimalPlace=1, RoundType=0)  # -> Rounded, Difference
roundd_9 = RoundToDecimalPlace(NumberX=area_41.Area, DecimalPlace=1, RoundType=0)  # -> Rounded, Difference
division_13 = Division(A=roundd_3.Rounded, B=area_41.Area)
roundd_10 = RoundToDecimalPlace(NumberX=ma_4.Result, DecimalPlace=1, RoundType=0)  # -> Rounded, Difference
roundd_11 = RoundToDecimalPlace(NumberX=subtraction_11, DecimalPlace=1, RoundType=0)  # -> Rounded, Difference
roundd_12 = RoundToDecimalPlace(NumberX=multiplication_20, DecimalPlace=1, RoundType=0)  # -> Rounded, Difference
multiplication_26 = Multiplication(A=division_12, B=2)
division_14 = Division(A=ma_19.Result, B=1000)
roundd_13 = RoundToDecimalPlace(NumberX=avr_10, DecimalPlace=1, RoundType=0)  # -> Rounded, Difference
roundd_14 = RoundToDecimalPlace(NumberX=lawn_sequestration, DecimalPlace=1, RoundType=0)  # -> Rounded, Difference
addition_12 = Addition(A=addition_9, B=roundd_14.Rounded)
dedomain_12 = DeconstructDomain(Domain=bnd_17)  # -> Start, End
roundd_15 = RoundToDecimalPlace(NumberX=ma_18.Result, DecimalPlace=1, RoundType=0)  # -> Rounded, Difference
roundd_16 = RoundToDecimalPlace(NumberX=ma_15.Result, DecimalPlace=1, RoundType=0)  # -> Rounded, Difference
roundd_17 = RoundToDecimalPlace(NumberX=ma_16.Result, DecimalPlace=1, RoundType=0)  # -> Rounded, Difference
roundd_18 = RoundToDecimalPlace(NumberX=ma_17.Result, DecimalPlace=1, RoundType=0)  # -> Rounded, Difference
int_2 = Integer(multiplication_25)
int_3 = Integer(kwh_summer)
int_4 = Integer(kwh_autumn)
int_5 = Integer(kwh_spring)
roundd_19 = RoundToDecimalPlace(NumberX=ma_20.Result, DecimalPlace=1, RoundType=0)  # -> Rounded, Difference
int_6 = Integer(kwh_winter)
total_no_trees = Panel(ma_3.Result)
no_existing_trees = Panel(existing_trees)
no_planted_trees = Panel(addition_8)
average_building_height_m = Panel(roundd_13.Rounded)
total_residential_floor_area_sq_m = Panel(roundd_7.Rounded)
approx_co2_sequestration_from_trees_kg_y = Panel(addition_9)  # "Approx. CO2 Sequestration from Trees (kg/year)"
total_institutional_floor_area_sq_m = Panel(roundd_6.Rounded)
tallest_building_m = Panel(dedomain_12.End)
total_saleable_residential_floor_area_sq = Panel(roundd_8.Rounded)  # "Total Saleable Residential Floor Area (sq.m)"
approx_co2_sequestration_from_grass_area = Panel(roundd_14.Rounded)  # "Approx. CO2 Sequestration from Grass Areas (kg/year)"
approx_no_residential_units = Panel(int)
approx_no_residents = Panel(int_2)
total_building_footprint_sq_m = Panel(roundd_4.Rounded)
built_up_area_sq_m = Panel(roundd_11.Rounded)
site_area_sq_m = Panel(roundd_9.Rounded)
total_retail_floor_area_sq_m = Panel(roundd_5.Rounded)
total_office_floor_area_sq_m = Panel(roundd_2.Rounded)
total_built_floor_area_sq_m = Panel(roundd_3.Rounded)
green_space_area_sq_m = Panel(roundd_10.Rounded)
approx_total_carbon_sequestration_kg_yea = Panel(addition_12)  # "Approx. Total Carbon Sequestration (kg/year)"
site_floor_area_ratio_far = Panel(division_13)
total_car_street_length_km = Panel(division_14)
total_bike_lane_length_km = Panel(multiplication_26)
total_sidewalk_area_sq_m = Panel(roundd_16.Rounded)
total_bike_lane_area_sq_m = Panel(roundd_17.Rounded)
total_street_surface_area_sq_m = Panel(roundd_18.Rounded)
total_paved_area_sq_m = Panel(roundd_15.Rounded)
courtyard_area = Panel(roundd_19.Rounded)
panel_14 = Panel(int_3)
panel_15 = Panel(int_4)
panel_16 = Panel(int_6)
panel_17 = Panel(int_5)
m_2_employee = Slider(15, range=0..20)
division_15 = Division(A=ma_8.Result, B=m_2_employee)
division_16 = Division(A=total_retail_floor_area_sq_m, B=total_built_floor_area_sq_m)
division_17 = Division(A=total_office_floor_area_sq_m, B=total_built_floor_area_sq_m)
division_18 = Division(A=total_institutional_floor_area_sq_m, B=total_built_floor_area_sq_m)
division_19 = Division(A=total_residential_floor_area_sq_m, B=total_built_floor_area_sq_m)
addition_13 = Addition(A=ma_4.Result, B=permeability_factor)
ma_21 = MassAddition(Input=[int_3, int_4, int_6, int_5])  # -> Result, PartialResults
division_20 = Division(A=addition_13, B=roundd_9.Rounded)
multiplication_27 = Multiplication(A=division_18, B=100)
multiplication_28 = Multiplication(A=division_17, B=100)
multiplication_29 = Multiplication(A=division_16, B=100)
multiplication_30 = Multiplication(A=division_19, B=100)
int_7 = Integer(ma_21.Result)
int_8 = Integer(division_15)
multiplication_31 = Multiplication(A=division_20, B=100)
division_21 = Division(A=ma_4.Result, B=approx_no_residents)
division_22 = Division(A=ma_3.Result, B=int_2)
roundd_20 = RoundToDecimalPlace(NumberX=multiplication_28, DecimalPlace=1, RoundType=0)  # -> Rounded, Difference
roundd_21 = RoundToDecimalPlace(NumberX=multiplication_27, DecimalPlace=1, RoundType=0)  # -> Rounded, Difference
roundd_22 = RoundToDecimalPlace(NumberX=multiplication_29, DecimalPlace=1, RoundType=0)  # -> Rounded, Difference
roundd_23 = RoundToDecimalPlace(NumberX=multiplication_30, DecimalPlace=1, RoundType=0)  # -> Rounded, Difference
total_solar_energy_produced_kwh = Panel(int_7)
roundd_24 = RoundToDecimalPlace(NumberX=division_21, DecimalPlace=1, RoundType=0)  # -> Rounded, Difference
roundd_25 = RoundToDecimalPlace(NumberX=multiplication_31, DecimalPlace=1, RoundType=0)  # -> Rounded, Difference
trees_per_capita = Panel(division_22)
approx_no_of_office_workspaces = Panel(int_8)
office_space = Panel(roundd_20.Rounded)
retail_space = Panel(roundd_22.Rounded)
institutional_space = Panel(roundd_21.Rounded)
residential_space = Panel(roundd_23.Rounded)
subtraction_13 = Subtraction(A=100, B=roundd_12.Rounded)
green_space_per_capita_sq_m_person = Panel(roundd_24.Rounded)
green_space = Panel(roundd_12.Rounded)

addition_14 = Addition(A=ma_20.Result, B=ma.Result)
division_23 = Division(A=roundd_3.Rounded, B=ma_2.Result)
average_block_floor_area_ratio_far = Panel(division_23)
division_24 = Division(A=addition_14, B=area_41.Area)
multiplication_32 = Multiplication(A=division_24, B=100)
roundd_26 = RoundToDecimalPlace(NumberX=multiplication_32, DecimalPlace=1, RoundType=0)  # -> Rounded, Difference
semi_permeable_areas = Panel(roundd_26.Rounded)
subtraction_14 = Subtraction(A=subtraction_13, B=roundd_26.Rounded)

total_semi_permeable_urban_areas_sq_m = Panel(addition_14)
sealed_surfaces = Panel(subtraction_14)
