# Grasshopper definition Green Areas.gh (Grasshopper 1.0.7)

# ----
# Both connect to Extract Polygons
# component in 'Generate Street Blocks' Group
# Green areas exclusion & definition
# connects to geo in 'Simple Offset' group
# extract spaces which do not intersect
# Connect to GreenSpace layer for Rhino input geometry (or pipeline)
# test for intersection w/ green spaces
# extract spaces which do intersect
# merge with small green spaces
# to plug-into tree generator
# Connect to Site Boundary geometry (or pipeline)
pipeline = GeometryPipeline(
    GroupByLayer=False,
    GroupByType=False,
    IncludeHidden=True,
    IncludeLocked=True,
    LayerFilter="*GreenSpace",
    NameFilter="*",
    SublayerFiltering=True,
    TypeFilter=4)
pipeline_2 = GeometryPipeline(
    GroupByLayer=False,
    GroupByType=False,
    IncludeHidden=True,
    IncludeLocked=True,
    LayerFilter="*ScenarioMax::Boundary",
    NameFilter="*",
    SublayerFiltering=True,
    TypeFilter=4)
Z = UnitZ(Factor=Slider(5, range=0..10))
boundary = BoundarySurfaces(Edges=pipeline)
rev = Reverse(Vector=Z)
boundary_2 = BoundarySurfaces(Edges=pipeline_2)
move = Move(Geometry=boundary_2, Motion=rev)  # -> Geometry, Transform
Z_2 = UnitZ(Factor=1)
boundary_3 = BoundarySurfaces()
relay = Relay()
extr = Extrude(Base=boundary, Direction=rev)
extr_2 = Extrude(Base=move.Geometry, Direction=Z_2)
Z_3 = UnitZ(Factor=1)
cap = CapHoles(Brep=extr)
cap_2 = CapHoles(Brep=extr_2)
extr_3 = Extrude(Base=boundary_3, Direction=Z_3)
sunion = SolidUnion(Breps=[cap_2, cap])
shapein = ShapeInBrep(Brep=extr_3, Shape=sunion)
subtraction = Subtraction(A=shapein, B=1)
bool = Boolean(subtraction)
graft = GraftTree(Tree=relay, IncludeEmptyLists=True, IncludeNullItems=True)  # -> simplify(Tree)
not = GateNot(A=bool)
graft_2 = GraftTree(Tree=bool, IncludeEmptyLists=True, IncludeNullItems=True)  # -> simplify(Tree)
graft_3 = GraftTree(Tree=not, IncludeEmptyLists=True, IncludeNullItems=True)  # -> simplify(Tree)
cull = CullPattern(List=graft, CullPattern=graft_2)
cull_2 = CullPattern(List=graft, CullPattern=graft_3)
flatten = FlattenTree(Tree=cull, Path="{0}")
flatten_2 = FlattenTree(Tree=cull_2, Path="{0}")
geo = Geometry(flatten)

geo_2 = Geometry(flatten_2)
