# Grasshopper definition Low Poly Tree Generator.gh (Grasshopper 1.0.7)

number_slider = Slider(271587.543, range=0..1000000)
pt = Point([<point referenced from the Rhino model> x7])
lng = ListLength(List=pt)
random = Random(Range=Domain(0, 1), Number=lng, Seed=number_slider)  # -> graft(Random)
dom = ConstructDomain(DomainStart=Slider(383, range=0..1200), DomainEnd=Slider(813, range=0..1200))
dom_2 = ConstructDomain(DomainStart=Slider(113, range=0..1200), DomainEnd=Slider(249, range=0..1200))
dom_3 = ConstructDomain(DomainStart=Slider(6, range=3..15), DomainEnd=Slider(23, range=3..30))
remap = RemapNumbers(Value=random, Source=Domain(0, 1), Target=[dom, dom_2, dom_3])  # -> simplify(Mapped), Clipped
item = ListItem(List=remap.Mapped, Index=0, Wrap=True)  # -> Item, Item1, Item2
Z = UnitZ(Factor=item.Item)
move = Move(Geometry=graft(pt), Motion=Z)  # -> Geometry, Transform
cyl = Cylinder(Base=graft(pt), Radius=expr("x/40", item.Item), Length=item.Item)
box = CenterBox(Base=move.Geometry, X=item.Item1, Y=item.Item1, Z=item.Item1)
pop3d = Populate3D(Region=box, Count=item.Item2, Seed=number_slider)  # -> simplify(Population)
facet = FacetDome(Points=pop3d)  # -> Pattern, Dome
boundary = BoundarySurfaces(Edges=facet.Pattern)
join = BrepJoin(Breps=boundary)  # -> Breps, Closed
sint = SolidIntersection(BrepsA=graft(box), BrepsB=graft(join.Breps))  # -> flatten(Result)
