# Grasshopper definition Street Trees.gh (Grasshopper 1.0.7)
# plug-ins: Pufferfish

# ----
# Street Trees
# Road type exclusion & definition
# Connects to Road offset slider in 'Simple Offset'
# connects to 'Line Segments' in 'Clean Street Network Geometry'
# extract streets which do not intersect
# Low Poly Tree Constructor
# could be useful for creating park paths
relay = Relay()
graft = GraftTree(Tree=relay, IncludeEmptyLists=True, IncludeNullItems=True)
graft_2 = GraftTree(IncludeEmptyLists=True, IncludeNullItems=True)
Z = UnitZ(Factor=Slider(8, range=0..10))
offcrv = OffsetCurve(Curve=graft, Plane=PlaneXY(0, 0, 0), Distance=1, BothSides=0, Kinks=0, CapType=1)
# Connects to 'SUnion' in 'Green Areas Exclusion & Definition'
boundary = BoundarySurfaces(Edges=offcrv)
extr = Extrude(Base=boundary, Direction=Z)
relay_2 = Relay()
shapein = ShapeInBrep(Brep=extr, Shape=relay_2)
subtraction = Subtraction(A=shapein, B=1)
graft_3 = GraftTree(Tree=relay, IncludeEmptyLists=True, IncludeNullItems=True)  # -> simplify(Tree)
bool = Boolean(subtraction)
not = GateNot(A=bool)
graft_4 = GraftTree(Tree=not, IncludeEmptyLists=True, IncludeNullItems=True)  # -> simplify(Tree)
graft_5 = GraftTree(Tree=bool, IncludeEmptyLists=True, IncludeNullItems=True)  # -> simplify(Tree)
relay_3 = Relay()
# extract streets which do intersect
cull = CullPattern(List=graft_3, CullPattern=graft_4)
cull_2 = CullPattern(List=graft_3, CullPattern=graft_5)
flatten = FlattenTree(Tree=cull, Path="{0}")
flatten_2 = FlattenTree(Tree=cull_2, Path="{0}")
abs = Absolute(Value=relay_3)
division = Division(A=abs, B=2)
geo = Geometry(flatten_2)
addition = Addition(A=division, B=1)
neg = Negative(Value=addition)
geo_2 = Geometry(flatten)
graft_6 = GraftTree(Tree=geo, IncludeEmptyLists=True, IncludeNullItems=True)
offcrv_2 = OffsetCurve(Curve=geo, Plane=PlaneXY(0, 0, 0), Distance=addition, BothSides=neg, Kinks=0, CapType=0)
len = Length(Curve=offcrv_2)
division_2 = Division(A=len, B=Slider(20, range=0..100))
round = Round(Number=division_2)  # -> Nearest, Floor, Ceiling
divide = DivideCurve(Curve=offcrv_2, Count=round.Nearest, Kinks=False)  # -> Points, Tangents, Parameters
lng = ListLength(List=divide.Parameters)
subtraction_2 = Subtraction(A=lng, B=1)
x_minus_one = XMinusOne(NumberX=subtraction_2)
item = ListItem(List=divide.Parameters, Index=x_minus_one, Wrap=True)
item_2 = ListItem(List=divide.Parameters, Index=subtraction_2, Wrap=True)
item_3 = ListItem(List=divide.Parameters, Index=Slider(1, range=0..1), Wrap=True)
division_3 = Division(A=item_3, B=2)
multiplication = Multiplication(A=item_3, B=0)
addition_2 = Addition(A=item_2, B=item)
replace = ReplaceItems(List=divide.Parameters, Item=division_3, Indices=multiplication, Wrap=False)
division_4 = Division(A=addition_2, B=2)
crv = Curve(simplify(graft(offcrv_2)))
replace_2 = ReplaceItems(List=replace, Item=division_4, Indices=subtraction_2, Wrap=False)  # -> simplify(List)
eval = EvaluateCurve(Curve=crv, Parameter=replace_2)  # -> Point, Tangent, Angle
number_slider = Slider(271587.543, range=0..1000000)
pt = Point(eval.Point)
lng_2 = ListLength(List=pt)
random = Random(Range=Domain(0, 1), Number=lng_2, Seed=number_slider)  # -> graft(Random)
dom = ConstructDomain(DomainStart=Slider(3, range=0..1200), DomainEnd=Slider(5, range=0..1200))
dom_2 = ConstructDomain(DomainStart=Slider(2, range=0..1200), DomainEnd=Slider(5, range=0..1200))
dom_3 = ConstructDomain(DomainStart=Slider(3, range=3..15), DomainEnd=Slider(12, range=3..30))
remap = RemapNumbers(Value=random, Source=Domain(0, 1), Target=[dom, dom_2, dom_3])  # -> simplify(Mapped), Clipped
item_4 = ListItem(List=remap.Mapped, Index=0, Wrap=True)  # -> Item, Item1, Item2
multiplication_2 = Multiplication(A=item_4.Item, B=1.5)
Z_2 = UnitZ(Factor=multiplication_2)
move = Move(Geometry=graft(pt), Motion=Z_2)  # -> Geometry, Transform
cyl = Cylinder(Base=graft(pt), Radius=expr("x/40", item_4.Item), Length=multiplication_2)
box = CenterBox(Base=move.Geometry, X=item_4.Item1, Y=item_4.Item1, Z=item_4.Item1)
pop3d = Populate3D(Region=box, Count=item_4.Item2, Seed=number_slider)  # -> simplify(Population)
preview = CustomPreview(
    Geometry=cyl,
    Material={diffuse=RGB(221, 160, 221), emission=RGB(66, 48, 66), shine=0.5, specular=RGB(255, 255, 255), transparency=0})
facet = FacetDome(Points=pop3d)  # -> Pattern, Dome
boundary_2 = BoundarySurfaces(Edges=facet.Pattern)
join = BrepJoin(Breps=boundary_2)  # -> Breps, Closed
sint = SolidIntersection(BrepsA=graft(box), BrepsB=graft(join.Breps))  # -> flatten(Result)
preview_2 = CustomPreview(Geometry=sint, Material=ColourSwatch(SwatchColor=RGBA(101, 178, 8, 152)))
