# Grasshopper definition StreetNetworkSmoothing_Final.gh (Grasshopper 1.0.7)
# plug-ins: PedSimulation, Kangaroo2 Components, Pufferfish, Python

geo = Geometry([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])
explode = Explode(Curve=geo, Recursive=True)  # -> Segments, Vertices
flatten = FlattenTree(Tree=explode.Segments, Path="{0}")
dupln = RemoveDuplicateLines(Lines=flatten, Tolerance=0.01)
shatter = MultiplesCurvesShatter(Curves=dupln)  # -> Points, Curves, Parame
crv = Curve(shatter.Curves)
end = EndPoints(Curve=crv)  # -> Start, End
# Version 2.
flatten_2 = FlattenTree(Tree=end.Start, Path="{0}")  # -> graft(Tree)
cps = ClosestPoints(Point=flatten(end.Start), Cloud=flatten(end.Start), Count=6)  # -> ClosestPoint, CPIndex, Distance
graft = GraftTree(Tree=end.Start, IncludeEmptyLists=True, IncludeNullItems=True)  # -> simplify(Tree)
graft_2 = GraftTree(Tree=end.Start, IncludeEmptyLists=True, IncludeNullItems=True)
graft_3 = GraftTree(Tree=end.End, IncludeEmptyLists=True, IncludeNullItems=True)
dist = Distance(PointA=flatten_2, PointB=cps.ClosestPoint)
radius_for_intersection_smoothing = Slider(25, range=0..100)
equalst = EqualityWithinTolerance(FirstNumber=dist, SecondNumber=0, Tolerance=Slider(0.01, range=0..0.01))  # -> Equality, Inequality
index = ItemIndex(List=equalst.Equality, Item=equalst.Equality)
cull = CullPattern(List=index, CullPattern=equalst.Equality)
replace = ReplaceItems(List=dist, Indices=cull, Wrap=True)
smaller = SmallerThan(FirstNumber=replace, SecondNumber=radius_for_intersection_smoothing)  # -> SmallerThan, OrEqualTo
nullrep = ReplaceNulls(Items=smaller.OrEqualTo, Replacements=Toggle(False))  # -> Items, Count
cull_2 = CullPattern(List=simplify(cps.ClosestPoint), CullPattern=simplify(nullrep.Items))
pdecon = Deconstruct(Point=graft)  # -> XComponent, YComponent, ZComponent
index_2 = ItemIndex(List=cull_2, Item=cull_2)
pdecon_2 = Deconstruct(Point=cull_2)  # -> XComponent, YComponent, ZComponent
merge = Merge(Data1=pdecon_2.YComponent, Data2=pdecon.YComponent)
merge_2 = Merge(Data1=pdecon_2.ZComponent, Data2=pdecon.ZComponent)
merge_3 = Merge(Data1=pdecon_2.XComponent, Data2=pdecon.XComponent)
dcon = DeleteConsecutive(Set=merge, Wrap=False)  # -> Set, Count
dcon_2 = DeleteConsecutive(Set=merge_2, Wrap=False)  # -> Set, Count
dcon_3 = DeleteConsecutive(Set=merge_3, Wrap=False)  # -> Set, Count
avr = Average(Input=dcon.Set)
avr_2 = Average(Input=dcon_2.Set)
avr_3 = Average(Input=dcon_3.Set)
pt = ConstructPoint(XCoordinate=avr_3, YCoordinate=avr, ZCoordinate=avr_2)
item = ListItem(List=pt, Index=index_2, Wrap=True)
flatten_3 = FlattenTree(Tree=pt, Path="{0}")
xy = XYPlane(Origin=item)
cir = Circle(Plane=xy, Radius=radius_for_intersection_smoothing)
# Connects to Boundary Surfaces in 'Buildings'
# Connects to ftpt (Building Footprints) from Buildings Component in 'Buildings'
cp = ClosestPoint(Point=graft_3, Cloud=flatten_3)  # -> ClosestPoint, CPIndex, Distance
cp_2 = ClosestPoint(Point=graft_2, Cloud=flatten_3)  # -> ClosestPoint, CPIndex, Distance
ln = Line(StartPoint=cp_2.ClosestPoint, EndPoint=cp.ClosestPoint)
end_2 = EndPoints(Curve=ln)  # -> Start, End
gate = Gate(Position=<missing>, GateName=<missing>, ExitTime=1, AccessRadius=<missing>, DrawDot=<missing>)  # disabled
gate_2 = Gate(Position=<missing>, GateName=<missing>, ExitTime=1, AccessRadius=<missing>, DrawDot=<missing>)  # disabled
program = Program(ProgramName=<missing>, DisplayColor=RGBA(0, 0, 0, 0))  # disabled
program_2 = Program(ProgramName=<missing>, DisplayColor=RGBA(0, 0, 0, 0))  # disabled
program_3 = Program(ProgramName=<missing>, DisplayColor=RGBA(0, 0, 0, 0))  # disabled
fanvision = FanShapedVision(Angle=<missing>, Distance=<missing>)  # disabled
panovision = PanoramaVision()  # disabled
target = Target(Position=<missing>, Program=program, VisitingTime=<missing>, AccessRadius=1, DrawDot=False, createMultipleTargets=True)  # disabled
target_2 = Target(Position=<missing>, Program=program_2, VisitingTime=<missing>, AccessRadius=1, DrawDot=False, createMultipleTargets=True)  # disabled
target_3 = Target(Position=<missing>, Program=program_3, VisitingTime=<missing>, AccessRadius=1, DrawDot=False, createMultipleTargets=True)  # disabled
# Connects to Boundary Surfaces in 'Buildings'
# Filters out weird duplicate surfaces
# Connects to ftpt (Building Footprints) from Buildings Component in 'Buildings'
pt_2 = PersonTemplate(
    StartGate=gate,
    DestinationGate=gate_2,
    Interests=program_3,
    NeedValue=1,
    StartNumber=0,
    Probability=<missing>,
    TimeLimit=-1,
    Vision=panovision,
    BodyRadius=<missing>,
    TargetForce=20,
    DisplayColor=RGBA(100, 100, 100, 155),
    PersonTemplateDirectionMode=1)  # disabled
pt_3 = PersonTemplate(
    StartGate=gate,
    DestinationGate=gate_2,
    Interests=program,
    NeedValue=1,
    StartNumber=0,
    Probability=<missing>,
    TimeLimit=-1,
    Vision=panovision,
    BodyRadius=<missing>,
    TargetForce=20,
    DisplayColor=RGBA(100, 100, 100, 155),
    PersonTemplateDirectionMode=1)  # disabled
pt_4 = PersonTemplate(
    StartGate=gate,
    DestinationGate=gate_2,
    Interests=program_2,
    NeedValue=1,
    StartNumber=0,
    Probability=<missing>,
    TimeLimit=-1,
    Vision=panovision,
    BodyRadius=<missing>,
    TargetForce=20,
    DisplayColor=RGBA(100, 100, 100, 155),
    PersonTemplateDirectionMode=1)  # disabled
settings = SystemSettings(
    FPS=<missing>,
    ObstacleOffset=1,
    ObstacleRepulsionCoefA=50,
    ObstacleRepulsionCoefB=2,
    ObstacleRepulsionMax=5,
    ObstacleRepulsionThreshold=0.5,
    EnableTrace=<missing>)  # disabled
pedsim = PedSimulationSystem(
    Reset=<missing>,
    PersonTemplates=<missing>,
    ObstacleCurves=<missing>,
    Population=<missing>,
    Targets=<missing>,
    GenerationTime=1,
    SystemSettings=settings)  # -> Out, People, GraphEdges, GraphVertices, GoalTagPositions, VisitCounts, PersonRecords; disabled
drawperson = DrawPerson(People=pedsim.People, drawCurrentTargetFill=False, drawFOV=False, drawNumber=False)  # disabled
gscounter = GridSpeedCounter(
    Reset=<missing>,
    People=<missing>,
    BasePt=<missing>,
    CellSize=<missing>,
    ExtentX=<missing>,
    ExtentY=<missing>,
    NumFrames=20)  # -> AvgSpeed, MaxSpeed; disabled
gpcounter = GridPersonCounter(
    Reset=<missing>,
    People=<missing>,
    BasePt=<missing>,
    CellSize=<missing>,
    ExtentX=<missing>,
    ExtentY=<missing>,
    GridPersonCounterMode=3)  # -> Count, MaxCount; disabled
