# Grasshopper definition Topography-Constructor.gh (Grasshopper 1.0.7)
# plug-ins: Kangaroo2 Components

# ----
# La-Bobilla Topography constructor
path = FilePath("Z:\projects\45HUP EU Horizon Mission UP2030\gh\GH+Rhino\V2\Base-Geo\SRTM-Coordinates_AOI-2km.csv")
file = ReadFile(File=path, PerLineParse=True)
split = SplitList(List=file, Index="1")  # -> ListA, ListB
split_2 = TextSplit(Text=split.ListB, Separators=",")
number_slider = Slider(1, range=0..1000)
item = ListItem(List=split_2, Index="0", Wrap=True)  # -> flatten(Item)
item_2 = ListItem(List=split_2, Index="1", Wrap=True)  # -> flatten(Item)
item_3 = ListItem(List=split_2, Index="2", Wrap=True)  # -> flatten(Item)
multiplication = Multiplication(A=item, B=number_slider)
multiplication_2 = Multiplication(A=item_2, B=number_slider)
multiplication_3 = Multiplication(A=item_3, B=number_slider)
pt = ConstructPoint(XCoordinate=multiplication_2, YCoordinate=multiplication_3, ZCoordinate=multiplication)
del = DelaunayMesh(Points=flatten(pt), Plane=PlaneXY(0, 0, 0))
preview = CustomPreview(Geometry=del, Material=ColourSwatch(SwatchColor=RGB(255, 217, 120)))

crv = Curve(<curve referenced from the Rhino model>)
patch = Patch(Curves=crv, Points=pt, Spans=Slider(62, range=0..100), Flexibility=Slider(52, range=0..100), Trim=True)

# ----
# Image to surface mapping
resolution = Panel("300")
input_surface = Srf(patch)
range = Range(Domain=Domain(0, 1), Steps=resolution)
mesh_uv = MeshSurface(Surface=input_surface, UCount=resolution, VCount=resolution, Overhang=True, Equalize=False)
mcol = MeshColours(
    Mesh=mesh_uv,
    Colours=[RGB(127, 255, 0), RGB(0, 100, 0), RGB(34, 139, 34), RGB(124, 252, 0), RGB(154, 205, 50), RGB(173, 255, 47), RGB(50, 205, 50), RGB(152, 251, 152)])

# ----
# cross reference data matching
pt_2 = PointXYZ(XComponent=range, YComponent=range, ZComponent=0, DataComparison="cross_reference")

crv_2 = Curve(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)
end = EndPoints(Curve=crv_2)  # -> Start, End
move = Move(Motion=Vector(0, 0, 10))  # -> Geometry, Transform
vec2pt = Vector2Pt(PointA=end.Start, PointB=end.End, Unitize=False)  # -> Vector, Length
pipeline = GeometryPipeline(
    GroupByLayer=False,
    GroupByType=False,
    IncludeHidden=True,
    IncludeLocked=True,
    LayerFilter="*BakedGeometry::Buildings::Mixed",
    NameFilter="*",
    SublayerFiltering=True,
    TypeFilter=1073741848)
project = Project(Direction=Vector(0, 0, 1))

# ---- group: Building
geometry = Geometry(pipeline)

# ----
pipeline_2 = GeometryPipeline(
    GroupByLayer=False,
    GroupByType=False,
    IncludeHidden=True,
    IncludeLocked=True,
    LayerFilter="*BakedGeometry::Paved Surfaces::Sidewalks",
    NameFilter="*",
    SublayerFiltering=True,
    TypeFilter=1073741848)
move_2 = Move(Geometry=del, Motion=vec2pt.Vector)  # -> Geometry, Transform

# ----
# Mesh to Surface
mesh = Mesh(move_2.Geometry)
demesh = DeconstructMesh(Mesh=mesh)  # -> Vertices, Faces, Colours, Normals
project_2 = Project(Geometry=demesh.Vertices, Plane=PlaneXY(0, 0, 0))  # -> Geometry, Transform
hull = ConvexHull(Points=project_2.Geometry, Plane=PlaneXY(0, 0, 0))  # -> Hull, HullZ, Indices
discontinuity = Discontinuity(Curve=hull.Hull, Level=1)  # -> Points, Parameters
Y = UnitY(Factor=1)
X = UnitX(Factor=1)
conmesh = ConstructMesh(Vertices=project_2.Geometry, Faces=demesh.Faces)
edgesdir = EdgesFromDirections(Brep=hull.Hull, Directions=[X, Y], Reflex=invert(True), Angle=".1")  # -> Edges, Indices, Map
crv_cp = CurveClosestPoint(Point=discontinuity.Points, Curve=hull.Hull)  # -> Point, Parameter, Distance
shatter = Shatter(Curve=hull.Hull, Parameters=crv_cp.Parameter)
item_4 = ListItem(List=shatter, Index=edgesdir.Indices, Wrap=True)  # -> graft(Item)
crv_cp_2 = CurveClosestPoint(Point=project_2.Geometry, Curve=item_4)  # -> Point, Parameter, Distance
smaller = SmallerThan(FirstNumber=crv_cp_2.Distance, SecondNumber="0.001")  # -> SmallerThan, OrEqualTo
dispatch = Dispatch(List=project_2.Geometry, DispatchPattern=smaller.SmallerThan)  # -> ListA, ListB
lng = ListLength(List=dispatch.ListA)
pshift = ShiftPaths(Data=lng, Offset=-1)  # -> graft(Data)
bang = ExplodeTree(Data=pshift)  # -> _0000, _0001
sdivide = DivideSurface(Surface=hull.Hull, UCount=bang._0000, VCount=bang._0001)  # -> Points, Normals, Parameters
pshift_2 = ShiftPaths(Data=sdivide.Points, Offset=-1)
meshmap = MeshMap(SourceMesh=conmesh, TargetMesh=mesh, Point=pshift_2, Distance=1)
srfgrid = SurfaceFromPoints(Points=meshmap, UCount=expr("x+1", bang._0000), Interpolate=False)  # -> flatten(Surface)
panel = Panel(srfgrid)

# ---- group: Topography
surface = Surface(srfgrid)

# ----
amoments = AreaMoments(Geometry=geometry)  # -> Area, Centroid, Inertia, InertiaError, Secondary, SecondaryError, Gyration
pt_3 = Point(Point(-6938.610562, 460.7623914, 0))
xy = XYPlane(Origin=pt_3)
project_3 = Project(Plane=PlaneXY(0, 0, 0))  # -> Geometry, Transform
project_4 = Project(Geometry=amoments.Centroid, Plane=xy)  # -> Geometry, Transform
Z = UnitZ(Factor=1)
line = LineSDL(Start=project_4.Geometry, Direction=Z, Length=Slider(3000, range=0..10000))
panel_2 = Panel(pipeline)
bcx = BrepCurve(Brep=surface, Curve=graft(line))  # -> Curves, Points
project_5 = Project(Plane=PlaneXY(0, 0, 0))  # -> Geometry, Transform
vec2pt_2 = Vector2Pt(PointA=project_4.Geometry, PointB=flatten(bcx.Points), Unitize=False)  # -> Vector, Length
move_3 = Move(Geometry=geometry, Motion=vec2pt_2.Vector)  # -> Geometry, Transform
