# Grasshopper definition roadtypedifferentiator.gh (Grasshopper 1.0.7)
# plug-ins: DeCodingSpaces, Human, Pufferfish, GhPython Script

geo = Geometry([<curve referenced from the Rhino model> x30])
_1_process_geometry = _1ProcessGeometry(Path=geo, SegmentLength=10000)  # -> Object, Segments, Vectors, Ids
_2_build_graph = _2BuildGraph(
    Object=_1_process_geometry.Object,
    LengthCoefficient=0,
    AngularCoefficient=1,
    AdditionalEdgeWeightCoefficient=0,
    CalculateDegree=False,
    CalculateInverseGraph=False,
    CopyObject=True)  # -> Object, InverseGraphEdges, Vertices, ReferencedEdges, DegreeCentrality
geo_2 = Geometry(_1_process_geometry.Segments)
_3_shortest_path_floyd_warshal = _3ShortestFloydWarshal(Object=_2_build_graph.Object, CopyObject=True, IncludeMaA=False, UseGPU=False)
_4_f_w_get_paths = _4FWGetPaths(
    Object=_3_shortest_path_floyd_warshal,
    PairwiseShortestPaths=False,
    Radius=0,
    CopyObject=True,
    MaskInputString="00000011",
    PathInfoForPoints=False,
    UseGPU=False)  # -> BetweennessCentrality, ClosenessCentrality, Gravity, BetweennessCentralityWeighted, ClosenessCentralityWeighted, SupplementaryGeometry, PathsInformation
dom = ConstructDomain(DomainStart=0, DomainEnd=1)
recrvdom = RemapCurveDomain(Curve=_1_process_geometry.Segments, Domain=dom)  # -> Remapped, Original, New
ln = NaturalLogarithm(Value=_4_f_w_get_paths.BetweennessCentrality)
bnd = Bounds(Numbers=ln)
eval = EvaluateCurve(Curve=recrvdom.Remapped, Parameter=0.5)  # -> Point, Tangent, Angle
remap = RemapNumbers(Value=ln, Source=bnd, Target=Domain(0, 1))  # -> Mapped, Clipped

# ----
# Generate Street Blocks
# Controls the Street Widths
# based on the street centrality values
number_slider = Slider(6199, range=0..10000)  # disabled
expscaling = Slider(0.4, range=0..1)  # disabled
extract_polygons = PolygonsFromLines(MinBlockSize=0)  # -> Polygons, SynchronizedValues; disabled
linearscaling = Slider(0.15, range=0..1)  # disabled
pow = Power(A=extract_polygons.SynchronizedValues, B=expscaling)  # disabled
multiplication = Multiplication(A=pow, B=linearscaling)  # disabled
custoffset = CustomOffset(Polygons=extract_polygons.Polygons, OffsetValues=expr("x*-1", multiplication))  # -> OffsetedPolygons, Test; disabled
sort = SortList(Keys=pow, ValuesA=pow)  # -> Keys, ValuesA; disabled
rev = ReverseList(List=sort.Keys)  # disabled
number_slider_2 = Slider(12, range=0..15)  # disabled
pcol = PolylineCollapse(Polyline=custoffset.OffsetedPolygons, Tolerance=number_slider_2)  # -> Polyline, Count; disabled
simplify = SimplifyCurve(Curve=pcol.Polyline, Tolerance=number_slider_2, AngleTolerance=10)  # -> Curve, Simplified; disabled
item = ListItem(List=rev, Index=0, Wrap=True)  # -> flatten(Item); disabled
geo_3 = Geometry(simplify.Curve)  # disabled
boundary = BoundarySurfaces(Edges=simplify.Curve)  # disabled
Z = UnitZ(Factor=-0.1)  # disabled
bnd_2 = Bounds(Numbers=item)  # disabled
move = Move(Geometry=boundary, Motion=Z)  # -> Geometry, Transform; disabled
remap_2 = RemapNumbers(Value=item, Source=bnd_2, Target=Domain(0, 1))  # -> Mapped, Clipped; disabled
streetblocks = Curve(simplify(geo_3))  # disabled
preview = CustomPreview(
    Geometry=move.Geometry,
    Material={diffuse=RGB(221, 160, 221), emission=RGB(66, 48, 66), shine=0.5, specular=RGB(255, 255, 255), transparency=0})  # disabled

primary_streets = Curve([<curve referenced from the Rhino model> x3])
gradient = Gradient(LowerLimit=0, UpperLimit=1, Parameter=remap.Mapped, stops=[0: RGB(0, 128, 0), 0.5: RGB(255, 255, 0), 1: RGB(255, 0, 0)])
ribbon = Ribbon(Curves=primary_streets, Distance=Slider(32, range=0..100), Union=False)
incurves = PointInCurves(Point=eval.Point, Curves=ribbon)  # -> Relationship, Index, Point
equals = Equality(FirstNumber=incurves.Relationship, SecondNumber=2)  # -> Equality, Inequality
dispatch = Dispatch(List=graft(incurves.Relationship), DispatchPattern=graft(equals.Equality))  # -> ListA, ListB
previewlw = CustomPreviewLineweights(Geometry=geo_2, Shader=gradient, Thickness=Slider(5, range=0..10), Absolute=False)
pow_2 = Power(A=dispatch.ListB, B=0)
pow_3 = Power(A=dispatch.ListA, B=0)
lng = ListLength(List=pow_3)
lng_2 = ListLength(List=pow_2)
dispatch_2 = Dispatch(List=0, DispatchPattern=lng)  # -> ListA, ListB
dispatch_3 = Dispatch(List=0, DispatchPattern=lng_2)  # -> ListA, ListB
data = Data([dispatch_2.ListB, pow_3])
data_2 = Data([dispatch_3.ListB, pow_2])
equals_2 = Equality(FirstNumber=data, SecondNumber=0)  # -> Equality, Inequality
multiplication_2 = Multiplication(A=data, B=Slider(9.7, range=0..10))
multiplication_3 = Multiplication(A=data_2, B=Slider(6, range=0..10))
equals_3 = Equality(FirstNumber=data_2, SecondNumber=0)  # -> Equality, Inequality
boundary_2 = BoundarySurfaces()  # disabled
cull = CullPattern(List=multiplication_2, CullPattern=equals_2.Inequality)
cull_2 = CullPattern(List=multiplication_3, CullPattern=equals_3.Inequality)
number_slider_3 = Slider(4, range=0..5)  # disabled
merge = Merge(Data1=cull, Data2=cull_2)  # -> flatten(Result)
multiplication_4 = Multiplication(A=merge, B=2)
ribbon_2 = Ribbon(Curves=graft(recrvdom.Remapped), Distance=graft(multiplication_4), Union=True)
runion = RegionUnion(Curves=flatten(ribbon_2))
crv = Curve(graft(runion))
dom_2 = ConstructDomain(DomainStart=0, DomainEnd=1)
recrvdom_2 = RemapCurveDomain(Curve=crv, Domain=dom_2)  # -> Remapped, Original, New
boundary_curve = Curve([<curve referenced from the Rhino model> x8])
eval_2 = EvaluateCurve(Curve=recrvdom_2.Remapped, Parameter=0.5)  # -> Point, Tangent, Angle
join = JoinCurves(Curves=boundary_curve, Preserve=False)
incurve = PointInCurve(Point=eval_2.Point, Curve=join)  # -> Relationship, Point
number_slider_4 = Slider(5.9, range=0..15)
equals_4 = Equality(FirstNumber=incurve.Relationship, SecondNumber=0)  # -> Equality, Inequality
cull_3 = CullPattern(List=recrvdom_2.Remapped, CullPattern=equals_4.Inequality)

# ----
# Parcelling multi parameter
# Controls the Plot Widths
# based on the street centrality values
number_slider_5 = Slider(30, range=0..100)  # disabled
number_slider_6 = Slider(12, range=0..100)  # disabled
bnd_3 = Bounds(Numbers=item)  # disabled
dom_3 = ConstructDomain(DomainStart=number_slider_6, DomainEnd=number_slider_5)  # disabled
remap_3 = RemapNumbers(Value=item, Source=bnd_3, Target=dom_3)  # -> Mapped, Clipped; disabled
custompars = CustomizedParameters(
    ScalingFactor=1,
    Length=10,
    Angle=90,
    NChildren=2,
    TreeDepth=7,
    MinDistance=1,
    MaxRank=4,
    Rank=0,
    ParcelWidth=remap_3.Mapped,
    Density=10,
    Seed=-1)  # disabled
slicing_tree = SlicingTreeStructureForParcels(CustomizsedParameters=custompars)  # -> simplify(Parcels); disabled
geo_4 = Geometry(slicing_tree)  # disabled

neg = Negative(Value=number_slider_4)
offcrv = OffsetCurve(Curve=cull_3, Plane=PlaneXY(0, 0, 0), Distance=neg, BothSides=0, Kinks=0, CapType=1)
offcrv_2 = OffsetCurve(Curve=offcrv, Plane=PlaneXY(0, 0, 0), Distance=number_slider_4, BothSides=0, Kinks=0, CapType=1)  # -> simplify(Offset)
custompars_2 = CustomizedParameters(
    ScalingFactor=1,
    MaxLength=100,
    MinLength=20,
    AngleRange=90,
    NChildren=3,
    TreeDepth=7,
    MinAngleD=10,
    MinDistance=1,
    MinBlockArea=800,
    BlockOffset=0,
    MaxRank=4,
    Rank=0,
    MaxArea=20,
    ParcelDepth=5,
    ParcelWidth=5,
    SplitRate=0.5,
    Density=10,
    Seed=-1)  # disabled
clean = CleanTree(RemoveNulls=True, RemoveInvalid=True, RemoveEmpty=True, Tree=offcrv_2)
crv_2 = Curve([clean, join])
blocks = Blocks()  # -> Blocks, BlockStreetSegmentPairs; disabled
boundary_3 = BoundarySurfaces(Edges=flatten(crv_2))
parcels = Parcels(ConnectionDistance=1, StreetOffset=0, PlotWidthThreshold=50, Precision=100)

# ---- group: Filter small parcels
number_slider_7 = Slider(400, range=0..1000)  # disabled
geo_5 = Geometry(geo_4)  # disabled
area = Area(Geometry=geo_5)  # -> Area, Centroid; disabled
larger = LargerThan(FirstNumber=area.Area, SecondNumber=number_slider_7)  # -> LargerThan, OrEqualTo; disabled
cull_4 = CullPattern(List=geo_5, CullPattern=larger.LargerThan)  # disabled
